# Grasshopper definition desk-generator.gh (Grasshopper 1.0.4)

slat_width = Slider(4, range=0..100)
slat_depth = Slider(31, range=0..100)
slat_rounding = Slider(0.6, range=0..10)
slat_count = Slider(10, range=0..10)
leg_radius = Slider(1, range=0..10)
leg_shaper = Slider(4, range=0..10)
leg_margin = Slider(2, range=0..10)

# ---- group: Draw Leg Shape
polygon = Polygon(Plane=PlaneXY(0, 0, 0), Radius=leg_radius, Segments=leg_shaper, FilletRadius=0)  # -> Polygon, Length

# ---- group: Make First Slat
rectangle = Rectangle(Plane=PlaneXY(0, 0, 0), XSize=slat_width, YSize=slat_depth, Radius=slat_rounding)  # -> Rectangle, Length

# ---- group: Do Some Math to Determine Total Desk Width
multiplication = Multiplication(A=slat_width, B=slat_count)
panel = Panel(multiplication)

# ---- group: Move Leg into Desk
vector_xyz = VectorXYZ(XComponent=leg_margin, YComponent=leg_margin, ZComponent=0)  # -> Vector, Length
move = Move(Geometry=polygon.Polygon, Motion=vector_xyz.Vector)  # -> Geometry, Transform

# ---- group: Make Copies of Slat
unit_x = UnitX(Factor=slat_width)
linear_array = LinearArray(Geometry=rectangle.Rectangle, Direction=unit_x, Count=slat_count)  # -> Geometry, Transform

# ---- group: Mirror Bottom Leg Across to Top
construct_point = ConstructPoint(XCoordinate=0, YCoordinate=expr("x/2", slat_depth), ZCoordinate=0)
xz_plane = XZPlane(Origin=construct_point)
mirror = Mirror(Geometry=move.Geometry, Plane=xz_plane)  # -> Geometry, Transform

# ----
desk_thickness = Slider(1, range=0..10)

# ---- group: Mirror Left Legs Across to Right Side
construct_point_2 = ConstructPoint(XCoordinate=expr("x/2", multiplication), YCoordinate=0, ZCoordinate=0)
yz_plane = YZPlane(Origin=construct_point_2)
mirror_2 = Mirror(Geometry=[mirror.Geometry, move.Geometry], Plane=yz_plane)  # -> Geometry, Transform

# ---- group: Give Desk Thickness
unit_z = UnitZ(Factor=desk_thickness)
extrude = Extrude(Base=linear_array.Geometry, Direction=unit_z)

# ---- group: Put Top and Bottom Surfaces on Desk
cap_holes = CapHoles(Brep=extrude)

# ---- group: Cluster Legs Together
curve = Curve([mirror_2.Geometry, mirror.Geometry, move.Geometry])

# ----
custom_preview = CustomPreview(Geometry=cap_holes, Shader=ColourSwatch(SwatchColor=RGB(71, 71, 71)))
leg_length = Slider(39.1, range=0..100)

# ---- group: Give Legs Height
negative = Negative(Value=leg_length)
unit_z_2 = UnitZ(Factor=negative)
extrude_2 = Extrude(Base=curve, Direction=unit_z_2)

# ---- group: Give Legs Top and Bottoms
cap_holes_2 = CapHoles(Brep=extrude_2)

# ----
custom_preview_2 = CustomPreview(Geometry=cap_holes_2, Shader=ColourSwatch(SwatchColor=RGB(222, 222, 222)))
