# Grasshopper definition randompattern.gh (Grasshopper 1.0.4)

grid_point_count = Slider(30, range=0..100)
# Double check all random seeds!
overall_size = Slider(12, range=0..100)
division = Division(A=overall_size, B=grid_point_count)
square = Square(Plane=PlaneXY(0, 0, 0), Size=division, ExtentX=grid_point_count, ExtentY=grid_point_count)  # -> Cells, Points
flatten_tree = FlattenTree(Tree=square.Points, Path="{0}")

list_length = ListLength(List=flatten_tree)

# ---- group: Draw polygons of random size
max_size = Slider(0.6, range=0..10)
random = Random(Range=max_size, Number=list_length, Seed=2)
polygon = Polygon(Plane=flatten_tree, Radius=random, Segments=6, FilletRadius=0)  # -> Polygon, Length

# ---- group: Move polygons randomly
movement_randomness = Slider(4, range=0..10)
random_2 = Random(Range=movement_randomness, Number=list_length, Seed=20)
random_3 = Random(Range=movement_randomness, Number=list_length, Seed=288)
vector_xyz = VectorXYZ(XComponent=random_2, YComponent=random_3, ZComponent=0)  # -> Vector, Length
move = Move(Geometry=polygon.Polygon, Motion=vector_xyz.Vector)  # -> Geometry, Transform

# ----
jitter = Jitter(List=move.Geometry, Jitter=1, Seed=Slider(21, range=0..100))  # -> Values, Indices

# ---- group: Cut list randomly so that only some polygons get filled
list_length_2 = ListLength(List=jitter.Values)
multiplication = Multiplication(A=list_length_2, B=Slider(0.25, range=0..1))
split_list = SplitList(List=jitter.Values, Index=multiplication)  # -> ListA, ListB

# ---- group: Random Colors
random_4 = Random(Range=Slider(255, range=0..255), Number=list_length, Seed=48)
random_5 = Random(Range=Slider(75, range=0..255), Number=list_length, Seed=2)
random_6 = Random(Range=Slider(244, range=0..255), Number=list_length, Seed=21)
colour_rgb = ColourRGB(Alpha=255, Red=random_5, Green=random_4, Blue=random_6)

# ---- group: Fill in some polygons
boundary_surfaces = BoundarySurfaces(Edges=split_list.ListA)

# ----
list_length_3 = ListLength(List=boundary_surfaces)
custom_preview = CustomPreview(Geometry=move.Geometry, Shader=colour_rgb)

# ---- group: Random Colors
random_7 = Random(Range=Slider(255, range=0..255), Number=list_length_3, Seed=48)
random_8 = Random(Range=Slider(75, range=0..255), Number=list_length_3, Seed=2)
random_9 = Random(Range=Slider(244, range=0..255), Number=list_length_3, Seed=21)
colour_rgb_2 = ColourRGB(Alpha=255, Red=random_8, Green=random_7, Blue=random_9)

# ----
custom_preview_2 = CustomPreview(Geometry=boundary_surfaces, Shader=colour_rgb_2)
