# Grasshopper definition attractor+repulsor.gh (Grasshopper 1.0.4)

# ---- group: Draw Grid
grid_point_count = Slider(30, range=0..100)
overall_grid_size = Slider(12, range=0..100)
division = Division(A=overall_grid_size, B=grid_point_count)
square = Square(Plane=PlaneXY(0, 0, 0), Size=division, ExtentX=grid_point_count, ExtentY=grid_point_count)  # -> Cells, Points
flatten_tree = FlattenTree(Tree=square.Points, Path="{0}")

# ---- group: Attractor/Repulsor Point
construct_point = ConstructPoint(XCoordinate=Slider(2.41, range=0..10), YCoordinate=Slider(9.74, range=0..10), ZCoordinate=0)

# ---- group: Find highest and lowest distances from grid points to attractor/repulsor point
distance = Distance(PointA=construct_point, PointB=flatten_tree)
sort_list = SortList(Keys=distance)  # -> Keys, ValuesA
reverse_list = ReverseList(List=sort_list.Keys)
list_item = ListItem(List=sort_list.Keys, Index=0, Wrap=True)
list_item_2 = ListItem(List=reverse_list, Index=0, Wrap=True)
construct_domain = ConstructDomain(DomainStart=list_item, DomainEnd=list_item_2)

# ---- group: How big should the nearest and smallest polygons be?
construct_domain_2 = ConstructDomain(DomainStart=Slider(0.4, range=0..1), DomainEnd=Slider(0.04, range=0..1))
remap_numbers = RemapNumbers(Value=distance, Source=construct_domain, Target=construct_domain_2)  # -> Mapped, Clipped

# ---- group: How should the near and far points move?
construct_domain_3 = ConstructDomain(DomainStart=Slider(2.3, range=0..10), DomainEnd=Slider(5.3, range=0..10))
remap_numbers_2 = RemapNumbers(Value=distance, Source=construct_domain, Target=construct_domain_3)  # -> Mapped, Clipped

# ---- group: Remap distance to color
remap_numbers_3 = RemapNumbers(Value=distance, Source=construct_domain, Target="255")  # -> Mapped, Clipped
colour_rgb = ColourRGB(Alpha=255, Red=0, Green=0, Blue=remap_numbers_3.Mapped)

# ---- group: In what direction should the grid points move and how far?
vector_2pt = Vector2Pt(PointA=construct_point, PointB=flatten_tree, Unitize=False)  # -> Vector, Length
amplitude = Amplitude(Vector=vector_2pt.Vector, Amplitude=remap_numbers_2.Mapped)
move = Move(Geometry=flatten_tree, Motion=amplitude)  # -> Geometry, Transform

# ----
sphere = Sphere(Base=move.Geometry, Radius=remap_numbers.Mapped)
custom_preview = CustomPreview(Geometry=sphere, Shader=colour_rgb)
