# Grasshopper definition circles.gh (Grasshopper 1.0.4)

# ---- group: Draw grid of points
grid_points = Slider(15, range=0..100)
overall_grid_size = Slider(12, range=0..100)
division = Division(A=overall_grid_size, B=grid_points)
square = Square(Plane=PlaneXY(0, 0, 0), Size=division, ExtentX=grid_points, ExtentY=grid_points)  # -> Cells, flatten(Points)
flatten_tree = FlattenTree(Tree=square.Points, Path="{0}")

# ---- group: Movable Circle Sizer
construct_point = ConstructPoint(XCoordinate=Slider(7.3, range=0..10), YCoordinate=Slider(6.7, range=0..10), ZCoordinate=0)

# ----
grid = Point(flatten_tree)

# ---- group: Find distance between each grid point and sizing circle
distance = Distance(PointA=construct_point, PointB=grid)

# ---- group: Create domain of max and min distances
sort_list = SortList(Keys=distance)  # -> Keys, ValuesValuesA
reverse_list = ReverseList(List=sort_list.Keys)
list_item = ListItem(List=sort_list.Keys, Index=0, Wrap=True)
list_item_2 = ListItem(List=reverse_list, Index=0, Wrap=True)
construct_domain = ConstructDomain(DomainStart=list_item, DomainEnd=list_item_2)

# ---- group: Map distances to Radii
construct_domain_2 = ConstructDomain(DomainStart=Slider(0.36, range=0..1), DomainEnd=Slider(0.01, range=0..0.1))
remap_numbers = RemapNumbers(Value=distance, Source=construct_domain, Target=construct_domain_2)  # -> Mapped, Clipped

# ---- group: Map distances to color values
remap_numbers_2 = RemapNumbers(Value=distance, Source=construct_domain, Target="255")  # -> Mapped, Clipped
colour_rgb = ColourRGB(Alpha=255, Red=remap_numbers_2.Mapped, Green=0, Blue=remap_numbers_2.Mapped)

# ----
circle = Circle(Plane=grid, Radius=remap_numbers.Mapped)

# ---- group: Draw circles colored by distance from control point
boundary_surfaces = BoundarySurfaces(Edges=circle)
custom_preview = CustomPreview(Geometry=boundary_surfaces, Shader=colour_rgb)
