# Grasshopper definition datasamples.gh (Grasshopper 1.0.4)

panel = Panel("Time-Indexed")
panel_2 = Panel("3 Dimensional Path")
panel_3 = Panel("2D Matrix")
# Intensity of sunlight entering Zach’s apartment on from 12:01am to 11:59pm on 4/12/15.
panel_4 = Panel("""1.16
0.71
0.41
0.25
0.15
0.08
0.05
0.03
0.01
0.01
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""")
panel_5 = Panel("""51.5072759
51.0623551
50.9035305
53.3820287
33.8498458
39.2810502
46.0544459
50.4120332
34.9173073
53.2343427
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""")
# World’s 3000 Most Populous Cities Lat/Long
panel_6 = Panel("""-0.1276597
-1.3140919
-1.4041996
-1.4657174
-116.5378612
-76.567903
14.5046117
4.4436244
33.6373765
-0.5370209
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""")
panel_7 = Panel("""0.0
-0.722838
-1.430821
-2.12098
-2.789209
-3.429544
-4.032741
-4.583075
-5.04974
-5.356656
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""")
panel_8 = Panel("Motion Data")
panel_9 = Panel("""0.0
0.113512
0.239295
0.379973
0.539213
0.722388
0.937907
1.200162
1.537309
2.016946
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""")
panel_10 = Panel("""0.0
0.68163
1.376568
2.086421
2.813135
3.559069
4.326991
5.119679
5.937332
6.759373
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""")

# ---- group: Generate timespan on x axis
list_length = ListLength(List=panel_4)
range = Range(Domain=Slider(10, range=0..10), Steps=list_length)

# ---- group: Make points based on radial coordinates
radians = Radians(Degrees=panel_6)
radians_2 = Radians(Degrees=panel_5)
number_slider = Slider(7, range=0..10)
point_polar = PointPolar(BasePlane=PlaneXY(0, 0, 0), XYAngle=radians, ZAngle=radians_2, Offset=number_slider)

# ---- group: Standard Remapping Stuff
sort_list = SortList(Keys=panel_4)  # -> Keys, ValuesA
reverse_list = ReverseList(List=sort_list.Keys)
list_item = ListItem(List=sort_list.Keys, Index=0, Wrap=True)
list_item_2 = ListItem(List=reverse_list, Index=0, Wrap=True)
construct_domain = ConstructDomain(DomainStart=list_item, DomainEnd=list_item_2)

# ---- group: Draw 3d curve
construct_point = ConstructPoint(XCoordinate=panel_7, YCoordinate=panel_9, ZCoordinate=panel_10)
# Note that the curve is 'reparameterized' so that it came be evaluated as traveling from 0 to 1 rather than its natural length
interpolate = Interpolate(Vertices=construct_point, Degree=3, Periodic=False, KnotStyle=1)  # -> reparameterize(Curve), Length, Domain

# ---- group: Radius of Revolution at Min and Max
construct_domain_2 = ConstructDomain(DomainStart=Slider(0.1, range=0..10), DomainEnd=Slider(5.7, range=0..10))

# ---- group: evaluate the curve at intervals
range_2 = Range(Domain=Domain(0, 1), Steps=Slider(18, range=0..100))

# ---- group: Trim list down to preserve computer performance
split_list = SplitList(List=point_polar, Index=Slider(1000, range=0..1000))  # -> ListA, ListB

# ---- group: Determine how bendy the curve is
curvature = Curvature(Curve=interpolate.Curve, Parameter=range_2)  # -> Point, Curvature, Curvature_2

# ---- group: Make oceans
sphere = Sphere(Base=PlaneXY(0, 0, 0), Radius=number_slider)

# ----
remap_numbers = RemapNumbers(Value=panel_4, Source=construct_domain, Target=construct_domain_2)  # -> Mapped, Clipped

# ---- group: Draw spheres for cities
mesh_sphere = MeshSphere(Base=split_list.ListA, Radius=Slider(0.064, range=0..1), UCount=10, VCount=20)

# ---- group: Draw line from data
construct_point_2 = ConstructPoint(XCoordinate=range, YCoordinate=remap_numbers.Mapped, ZCoordinate=0)
polyline = PolyLine(Vertices=construct_point_2, Closed=False)

# ---- group: Line to Revolve Around
construct_point_3 = ConstructPoint(XCoordinate=0, YCoordinate=0, ZCoordinate=0)
unit_x = UnitX(Factor=1)
line_sdl = LineSDL(Start=construct_point_3, Direction=unit_x, Length=1)

# ---- group: Move globe over
unit_x_2 = UnitX(Factor=Slider(24, range=0..100))
move = Move(Geometry=mesh_sphere, Motion=unit_x_2)  # -> Geometry, Transform
move_2 = Move(Geometry=sphere, Motion=unit_x_2)  # -> Geometry, Transform

# ---- group: Use curvature to determine radius of variable pipe
pipe_variable = PipeVariable(Curve=interpolate.Curve, Parameters=range_2, Radii=curvature.Curvature, Caps=0)
cap_holes = CapHoles(Brep=pipe_variable)

# ---- group: Move pipe over
unit_x_3 = UnitX(Factor=Slider(43, range=0..100))
move_3 = Move(Geometry=cap_holes, Motion=unit_x_3)  # -> Geometry, Transform

# ----
revolution = Revolution(Curve=polyline, Axis=line_sdl, Domain=Domain(0, 6.283185307))
cap_holes_2 = CapHoles(Brep=revolution)

custom_preview = CustomPreview(Geometry=cap_holes_2, Shader=ColourSwatch(SwatchColor=RGB(86, 112, 199)))
custom_preview_2 = CustomPreview(Geometry=move.Geometry, Shader=ColourSwatch(SwatchColor=RGB(245, 245, 245)))
custom_preview_3 = CustomPreview(Geometry=move_2.Geometry, Shader=ColourSwatch(SwatchColor=RGB(63, 115, 143)))
custom_preview_4 = CustomPreview(Geometry=move_3.Geometry, Shader=ColourSwatch(SwatchColor=RGB(227, 158, 61)))
