# Grasshopper definition dataplot.gh (Grasshopper 1.0.4)

panel = Panel("""2.486686, 1.10744, 0.934021
8.758215, 7.961443, 0.440452
0.960045, 9.516898, 0.965176
9.142283, 0.918479, 1.504984
4.419898, 6.225771, 1.422512
9.717592, 4.613409, 1.807314
0.23115, 5.332513, 0.465347
6.13154, 3.183633, 0.808695
5.983811, 0.062063, 1.120022
2.671959, 3.858621, 0.598954
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""")
text_split = TextSplit(Text=panel, Separators=",")
numbers_to_points = NumbersToPoints(Numbers=text_split, Mask=4)
flatten_tree = FlattenTree(Tree=numbers_to_points, Path="{0}")

# ---- group: Fill a box with random points
center_box = CenterBox(Base=PlaneXY(0, 0, 0), X=Slider(10, range=0..10), Y=Slider(10, range=0..10), Z=Slider(5, range=0..10))
populate_3d = Populate3D(Region=center_box, Count=Slider(25, range=0..100), Seed=1)

# ---- group: Place points on an individual geometry
sphere = Sphere(Base=PlaneXY(0, 0, 0), Radius=Slider(5, range=0..10))
populate_geometry = PopulateGeometry(Geometry=sphere, Count=Slider(75, range=0..100), Seed=1)

# ----
point = Point(flatten(populate_3d))

construct_domain = ConstructDomain(DomainStart="-10", DomainEnd="10")
range = Range(Domain=construct_domain, Steps=Slider(20, range=0..100))

# ---- group: Boundary Solid
number_slider = Slider(25, range=0..100)
point_2 = Point(point)
mesh_sphere = MeshSphere(Base=PlaneXY(0, 0, 0), Radius=10, UCount=number_slider, VCount=number_slider)
deconstruct_mesh = DeconstructMesh(Mesh=mesh_sphere)  # -> Vertices, Faces, Colours, Normals
closest_point = ClosestPoint(Point=deconstruct_mesh.Vertices, Cloud=point_2)  # -> ClosestPoint, CPIndex, Distance
vector_2pt = Vector2Pt(PointA=deconstruct_mesh.Vertices, PointB=closest_point.ClosestPoint, Unitize=False)  # -> Vector, Length
vector_length = VectorLength(Vector=vector_2pt.Vector)
multiplication = Multiplication(A=vector_length, B=Slider(0.7, range=0..1))
amplitude = Amplitude(Vector=vector_2pt.Vector, Amplitude=multiplication)
move = Move(Geometry=deconstruct_mesh.Vertices, Motion=amplitude)  # -> Geometry, Transform
construct_mesh = ConstructMesh(Vertices=move.Geometry, Faces=deconstruct_mesh.Faces)

# ---- group: Relaxed Minimum Bounding Volume
point_3 = Point(point)
cull_duplicates = CullDuplicates(Points=point_3, Tolerance=0.01, CullMode=3)  # -> Points, Indices, Valence
bounding_box = BoundingBox(Content=cull_duplicates.Points, Plane=PlaneXY(0, 0, 0), UnionBox=True)  # -> Box, Box_2
box_corners = BoxCorners(Box=bounding_box.Box)  # -> CornerA, CornerB, CornerC, CornerD, CornerE, CornerF, CornerG, CornerH
sphere_4pt = Sphere4Pt(Point1=box_corners.CornerA, Point2=box_corners.CornerG, Point3=box_corners.CornerD, Point4=box_corners.CornerF)  # -> Center, Radius, Sphere
mesh_brep = MeshBrep(
    Brep=sphere_4pt.Sphere,
    Settings={GridMaxCount=0, GridMinCount=16, JaggedSeams=False, MaxEdgeLength=0, MinEdgeLength=0.0001, MinTolerance=0, Refine=True, RefineAngle=0, RelativeTolerance=0.65, SimplePlanes=True, Tolerance=0})
deconstruct_mesh_2 = DeconstructMesh(Mesh=mesh_brep)  # -> Vertices, Faces, Colours, Normals
closest_point_2 = ClosestPoint(Point=deconstruct_mesh_2.Vertices, Cloud=point_3)  # -> ClosestPoint, CPIndex, Distance
construct_mesh_2 = ConstructMesh(Vertices=closest_point_2.ClosestPoint, Faces=deconstruct_mesh_2.Faces)

# ---- group: Field Charge Patterns
construct_point = ConstructPoint(XCoordinate=0, YCoordinate=0, ZCoordinate=Slider(-10, range=-10..10))
xy_plane = XYPlane(Origin=construct_point)
metaball = MetaBall(Points=point, Plane=xy_plane, Point=point)

# ---- group: curvature pipe
interpolate = Interpolate(Vertices=point, Degree=Slider(3, range=0..10), Periodic=False, KnotStyle=1)  # -> reparameterize(Curve), Length, Domain
range_2 = Range(Domain=Domain(0, 1), Steps=Slider(30, range=0..100))
curvature = Curvature(Curve=interpolate.Curve, Parameter=range_2)  # -> Point, Curvature, Curvature_2
pipe_variable = PipeVariable(Curve=interpolate.Curve, Parameters=range_2, Radii=curvature.Curvature, Caps=0)

# ---- group: Voronoi Volume
facet_dome = FacetDome(Points=point, Radius=Slider(100, range=0..100))  # -> Pattern, Dome
boundary_surfaces = BoundarySurfaces(Edges=facet_dome.Pattern)

# ---- group: Piped Curve [Interp]
interpolate_2 = Interpolate(Vertices=point, Degree=Slider(3, range=0..10), Periodic=False, KnotStyle=1)  # -> Curve, Length, Domain
pipe = Pipe(Curve=interpolate_2.Curve, Radius=Slider(0.061, range=0..1), Caps=0)

# ---- group: Piped Curve [B-Spline]
nurbs_curve = NurbsCurve(Vertices=point, Degree=Slider(3, range=0..10), Periodic=False)  # -> Curve, Length, Domain
pipe_2 = Pipe(Curve=nurbs_curve.Curve, Radius=Slider(0.093, range=0..1), Caps=0)

# ---- group: Plotted Spheres
list_length = ListLength(List=point)
random = Random(Range=Slider(2.7, range=0..10), Number=list_length, Seed=2)
sphere_2 = Sphere(Base=point, Radius=random)

# ----
sort_points = SortPoints(Points=point)  # -> Points, Indices
nurbs_curve_2 = NurbsCurve(Vertices=sort_points.Points, Degree=Slider(3, range=0..10), Periodic=False)  # -> Curve, Length, Domain
pipe_3 = Pipe(Curve=nurbs_curve_2.Curve, Radius=Slider(0.2, range=0..1), Caps=0)

# ---- group: Delaunay Scaffold
delaunay_edges = DelaunayEdges(Points=point, Plane=PlaneXY(0, 0, 0))  # -> Connectivity, Edges
pipe_4 = Pipe(Curve=flatten(delaunay_edges.Edges), Radius=Slider(0.1, range=0..1), Caps=0)

# ---- group: Voronoi Cells
bounding_box_2 = BoundingBox(Content=point, Plane=PlaneXY(0, 0, 0), UnionBox=True)  # -> Box, Box_2
voronoi_3d = Voronoi3D(Points=point, Box=bounding_box_2.Box)  # -> Cells, Boundary

# ---- group: Hulls
convex_hull = ConvexHull(Points=point, Plane=PlaneXY(0, 0, 0))  # -> Hull, HullZ, Indices
patch = Patch(Curves=convex_hull.HullZ, Spans=20, Flexibility=1, Trim=True)
fragment_patch = FragmentPatch(Boundary=convex_hull.HullZ)

# ---- group: Delaunay and Smoothed Delaunay Surface
xy_plane_2 = XYPlane(Origin=Point(0, 0, 0))
delaunay_mesh = DelaunayMesh(Points=point, Plane=xy_plane_2)
smooth_mesh = SmoothMesh(Mesh=delaunay_mesh, Strength=Slider(1, range=0..1), SkipNaked=True, Iterations=Slider(12, range=0..100))
mesh = Mesh(delaunay_mesh)
