# Grasshopper definition delaunay_cast.gh (Grasshopper 1.0.4)
# plug-ins: MeshEdit Components, Weaverbird

# ---- group: Draw Ellipse
construct_point = ConstructPoint(XCoordinate=0, YCoordinate=Slider(0, range=0..10), ZCoordinate=0)
xz_plane = XZPlane(Origin=construct_point)
ellipse = Ellipse(Plane=xz_plane, Radius1=Slider(2.8, range=0..10), Radius2=Slider(3.7, range=0..10))  # -> Ellipse, Focus1, Focus2
radians = Radians(Degrees=Slider(0, range=0..100))
rotate = Rotate(Geometry=ellipse.Ellipse, Angle=radians, Plane=xz_plane)  # -> Geometry, Transform

# ----
construct_point_2 = ConstructPoint(XCoordinate=0, YCoordinate=Slider(3.5, range=0..10), ZCoordinate=0)
xz_plane_2 = XZPlane(Origin=construct_point_2)
ellipse_2 = Ellipse(Plane=xz_plane_2, Radius1=Slider(3.1, range=0..10), Radius2=Slider(4, range=0..10))  # -> Ellipse, Focus1, Focus2
radians_2 = Radians(Degrees=Slider(27, range=0..360))
rotate_2 = Rotate(Geometry=ellipse_2.Ellipse, Angle=radians_2, Plane=xz_plane_2)  # -> Geometry, Transform

# ---- group: Draw Ellipse
construct_point_3 = ConstructPoint(XCoordinate=0, YCoordinate=Slider(7.2, range=0..10), ZCoordinate=0)
xz_plane_3 = XZPlane(Origin=construct_point_3)
ellipse_3 = Ellipse(Plane=xz_plane_3, Radius1=Slider(2.5, range=0..10), Radius2=Slider(2.5, range=0..10))  # -> Ellipse, Focus1, Focus2
radians_3 = Radians(Degrees=Slider(35, range=0..100))
rotate_3 = Rotate(Geometry=ellipse_3.Ellipse, Angle=radians_3, Plane=xz_plane_3)  # -> Geometry, Transform

# ---- group: Draw Plane
construct_point_4 = ConstructPoint(XCoordinate=0, YCoordinate=Slider(15, range=0..20), ZCoordinate=0)
xz_plane_4 = XZPlane(Origin=construct_point_4)
ellipse_4 = Ellipse(Plane=xz_plane_4, Radius1=Slider(3, range=0..10), Radius2=Slider(3, range=0..10))  # -> Ellipse, Focus1, Focus2
radians_4 = Radians(Degrees=Slider(36, range=0..100))
rotate_4 = Rotate(Geometry=ellipse_4.Ellipse, Angle=radians_4, Plane=xz_plane_4)  # -> Geometry, Transform

# ---- group: Build Arm Form
loft = Loft(
    Curves=[rotate.Geometry, rotate_2.Geometry, rotate_3.Geometry, rotate_4.Geometry],
    Options={Adjust=False, Closed=False, LoftEnds=0, LoftSimp=0, LoftType=0, Rebuild=10, Refit=0.01})

# ----
cap_holes = CapHoles(Brep=loft)

# ---- group: Create cylinder to surround lofted form
bounding_box = BoundingBox(Content=cap_holes, Plane=PlaneXY(0, 0, 0))  # -> Box, Box_2
deconstruct_box = DeconstructBox(Box=bounding_box.Box)  # -> Plane, X, Y, Z
xz_plane_5 = XZPlane(Origin=Point(0, 0, 0))
cylinder = Cylinder(Base=xz_plane_5, Radius=deconstruct_box.X, Length=expr("-x", deconstruct_box.Y))

# ---- group: Scale the cylinder a bit to ensure it doesn’t touch the lofted form
volume = Volume(Geometry=cap_holes)  # -> Volume, Centroid
scale_nu = ScaleNU(Geometry=cylinder, Plane=volume.Centroid, ScaleX=1, ScaleY=Slider(1.25, range=0..10), ScaleZ=1)  # -> Geometry, Transform

# ---- group: Create mesh from cylinder and convert all rectangle patches to triangles
number_slider = Slider(20, range=0..100)
mesh_surface = MeshSurface(Surface=scale_nu.Geometry, UCount=number_slider, VCount=number_slider, Overhang=True, Equalize=False)
triangulate = Triangulate(Mesh=mesh_surface)  # -> Mesh, Count

# ---- group: Generate random points
populate_geometry = PopulateGeometry(Geometry=cap_holes, Count=Slider(52, range=0..100), Seed=1)

# ---- group: Take mesh apart into its faces and vertices
deconstruct_mesh = DeconstructMesh(Mesh=triangulate.Mesh)  # -> graft(Vertices), Faces, Colours, Normals

# ---- group: Replace vertices of mesh with their closest random points
closest_point = ClosestPoint(Point=deconstruct_mesh.Vertices, Cloud=populate_geometry)  # -> flatten(ClosestPoint), CPIndex, Distance
construct_mesh = ConstructMesh(Vertices=closest_point.ClosestPoint, Faces=deconstruct_mesh.Faces)

# ---- group: Clean Up Mesh
mesh_cullunused_vertices = MeshCullUnusedVertices(Mesh=construct_mesh)
mesh_unifynormals = MeshUnifyNormals(Mesh=mesh_cullunused_vertices)

# ---- group: Get corner points of mesh triangles
face_boundaries = FaceBoundaries(Mesh=mesh_unifynormals)
discontinuity = Discontinuity(Curve=face_boundaries, Level=1)  # -> Points, Parameters

# ---- group: Find center points and scale down triangles
average = Average(Input=discontinuity.Points)  # -> flatten(ArithmeticMean)
scale = Scale(Geometry=face_boundaries, Center=average, Factor=Slider(0.94, range=0..1))  # -> Geometry, Transform

# ---- group: Get triangle segments of original and scaled triangles
explode = Explode(Curve=face_boundaries, Recursive=True)  # -> Segments, Vertices
explode_2 = Explode(Curve=scale.Geometry, Recursive=True)  # -> Segments, Vertices

# ---- group: Create connecting surfaces and convert to mesh
number_slider_2 = Slider(1, range=0..1)
ruled_surface = RuledSurface(CurveA=explode.Segments, CurveB=explode_2.Segments)
mesh_surface_2 = MeshSurface(Surface=ruled_surface, UCount=number_slider_2, VCount=number_slider_2, Overhang=True, Equalize=False)

# ---- group: Join meshes together
flatten_tree = FlattenTree(Tree=mesh_surface_2, Path="{0}")
mesh_join = MeshJoin(Meshes=flatten_tree)

# ---- group: Add thickness
weaverbird_s_mesh_thicken = WeaverbirdsMeshThicken(MeshCurves=mesh_join, Distance=Slider(0.5, range=0..1), OffsetType=0)

# ---- group: Smooth!
weaverbird_s_catmull_clark_subdivision = WeaverbirdsCatmullClarkSubdivision(MeshCurves=weaverbird_s_mesh_thicken, Level=Slider(3, range=0..10), SmoothNakedEdges=1)

# ----
custom_preview = CustomPreview(Geometry=weaverbird_s_catmull_clark_subdivision, Shader=ColourSwatch(SwatchColor=RGB(74, 160, 189)))
