# Grasshopper definition imagesampler.gh (Grasshopper 1.0.4)

# ---- group: Make grid of points
number_slider = Slider(100, range=0..100)
division = Division(A=Slider(20, range=0..100), B=number_slider)
# The proportions of the image need to match the proportions of the grid!
# 
# This is how we would handle a 2x1 image
division_2 = Division(A=number_slider, B="2")
square = Square(Plane=PlaneXY(0, 0, 0), Size=division, ExtentX=number_slider, ExtentY=division_2)  # -> Cells, Points
flatten_tree = FlattenTree(Tree=square.Points, Path="{0}")

# ----
# The image sampler domain needs to match the grid!
image_sampler = ImageSampler(
    flatten_tree,
    FilePath="/Users/zap/Desktop/usamp.jpg",
    Filter="Value",
    Interpolate=False,
    Umax=20,
    Umin=0,
    Vmax=10,
    Vmin=0,
    Wrap=1)

# ---- group: shift points based on brightness
unit_z = UnitZ(Factor=image_sampler)
move = Move(Geometry=flatten_tree, Motion=unit_z)  # -> Geometry, Transform

# ----
delaunay_mesh = DelaunayMesh(Points=move.Geometry, Plane=PlaneXY(0, 0, 0))
