# Grasshopper definition voronoi_cast.gh (Grasshopper 1.0.4)
# plug-ins: MeshEdit Components, Weaverbird

# ---- group: Draw Ellipse
construct_point = ConstructPoint(XCoordinate=0, YCoordinate=Slider(0, range=0..10), ZCoordinate=0)
xz_plane = XZPlane(Origin=construct_point)
ellipse = Ellipse(Plane=xz_plane, Radius1=Slider(2.8, range=0..10), Radius2=Slider(3.7, range=0..10))  # -> Ellipse, Focus1, Focus2
radians = Radians(Degrees=Slider(0, range=0..100))
rotate = Rotate(Geometry=ellipse.Ellipse, Angle=radians, Plane=xz_plane)  # -> Geometry, Transform

# ----
construct_point_2 = ConstructPoint(XCoordinate=0, YCoordinate=Slider(3.5, range=0..10), ZCoordinate=0)
xz_plane_2 = XZPlane(Origin=construct_point_2)
ellipse_2 = Ellipse(Plane=xz_plane_2, Radius1=Slider(3.1, range=0..10), Radius2=Slider(4, range=0..10))  # -> Ellipse, Focus1, Focus2
radians_2 = Radians(Degrees=Slider(27, range=0..360))
rotate_2 = Rotate(Geometry=ellipse_2.Ellipse, Angle=radians_2, Plane=xz_plane_2)  # -> Geometry, Transform

# ---- group: Draw Ellipse
construct_point_3 = ConstructPoint(XCoordinate=0, YCoordinate=Slider(7.2, range=0..10), ZCoordinate=0)
xz_plane_3 = XZPlane(Origin=construct_point_3)
ellipse_3 = Ellipse(Plane=xz_plane_3, Radius1=Slider(2.3, range=0..10), Radius2=Slider(3.2, range=0..10))  # -> Ellipse, Focus1, Focus2
radians_3 = Radians(Degrees=Slider(35, range=0..100))
rotate_3 = Rotate(Geometry=ellipse_3.Ellipse, Angle=radians_3, Plane=xz_plane_3)  # -> Geometry, Transform

# ---- group: Draw Plane
construct_point_4 = ConstructPoint(XCoordinate=0, YCoordinate=Slider(17.6, range=0..20), ZCoordinate=0)
xz_plane_4 = XZPlane(Origin=construct_point_4)
ellipse_4 = Ellipse(Plane=xz_plane_4, Radius1=Slider(2.4, range=0..10), Radius2=Slider(2.9, range=0..10))  # -> Ellipse, Focus1, Focus2
radians_4 = Radians(Degrees=Slider(36, range=0..100))
rotate_4 = Rotate(Geometry=ellipse_4.Ellipse, Angle=radians_4, Plane=xz_plane_4)  # -> Geometry, Transform

# ---- group: Build Arm Form
loft = Loft(
    Curves=[rotate.Geometry, rotate_2.Geometry, rotate_3.Geometry, rotate_4.Geometry],
    Options={Adjust=False, Closed=False, LoftEnds=0, LoftSimp=0, LoftType=0, Rebuild=10, Refit=0.01})

# ---- group: Create
bounding_box = BoundingBox(Content=loft, Plane=PlaneXY(0, 0, 0), UnionBox=True)  # -> Box, Box_2
volume = Volume(Geometry=bounding_box.Box)  # -> Volume, Centroid
scale = Scale(Geometry=bounding_box.Box, Center=volume.Centroid, Factor="2")  # -> Geometry, Transform

# ---- group: Put Random Points on Surface
cell_count = Slider(53, range=0..100)
populate_geometry = PopulateGeometry(Geometry=loft, Count=cell_count, Seed=1)

# ---- group: Generate Voronoi Cells
voronoi_3d = Voronoi3D(Points=populate_geometry, Box=scale.Geometry)  # -> Cells, Boundary

# ---- group: Intersect Cells with Arm
brep_brep = BrepBrep(BrepA=loft, BrepB=voronoi_3d.Cells)  # -> Curves, Points

# ---- group: Remove Unnecessary Structure
flatten_tree = FlattenTree(Tree=brep_brep.Curves, Path="{0}")

# ---- group: Get Bend Points and Make Voronoi Shape into Polyline
discontinuity = Discontinuity(Curve=flatten_tree, Level=1)  # -> Points, Parameters
polyline = PolyLine(Vertices=discontinuity.Points, Closed=True)

# ----
# Deaw a curve in Rhino to model the arm *break* location
# 
# Right Click on the Curve node above, and "Set One Curve". Select the curve in Rino
curve = Curve(<curve referenced from the Rhino model>)

# ---- group: Find Center Points of All Cells
average = Average(Input=discontinuity.Points)

# ----
curve_closest_point = CurveClosestPoint(Point=average, Curve=curve)  # -> Point, Parameter, Distance

# ---- group: Standard Remapping Based on High Low
flatten_tree_2 = FlattenTree(Tree=curve_closest_point.Distance, Path="{0}")
sort_list = SortList(Keys=flatten_tree_2)  # -> Keys, ValuesValuesA
reverse_list = ReverseList(List=sort_list.Keys)
list_item = ListItem(List=sort_list.Keys, Index=0, Wrap=True)
list_item_2 = ListItem(List=reverse_list, Index=0, Wrap=True)
construct_domain = ConstructDomain(DomainStart=Slider(0.22, range=0..1), DomainEnd=Slider(0.94, range=0..1))
construct_domain_2 = ConstructDomain(DomainStart=list_item, DomainEnd=list_item_2)
remap_numbers = RemapNumbers(Value=curve_closest_point.Distance, Source=construct_domain_2, Target=construct_domain)  # -> Mapped, Clipped
graft_tree = GraftTree(Tree=remap_numbers.Mapped, IncludeEmptyLists=True, IncludeNullItems=True)

# ---- group: Scale to Create Interior Offsets
scale_2 = Scale(Geometry=polyline, Center=average, Factor=graft_tree)  # -> Geometry, Transform

# ---- group: Cut Up Inner and Outer Cells into Individual Line Segments
explode = Explode(Curve=polyline, Recursive=True)  # -> Segments, Vertices
explode_2 = Explode(Curve=scale_2.Geometry, Recursive=True)  # -> Segments, Vertices

# ---- group: Make Surfaces
ruled_surface = RuledSurface(CurveA=explode.Segments, CurveB=explode_2.Segments)

# ---- group: Make very simple mesh quads for each surface
mesh_surface = MeshSurface(Surface=ruled_surface, UCount="1", VCount="1", Overhang=True, Equalize=False)

# ---- group: Join Meshes Together
flatten_tree_3 = FlattenTree(Tree=mesh_surface, Path="{0}")
weaverbird_s_join_meshes_and_weld = WeaverbirdsJoinMeshesAndWeld(Mesh=flatten_tree_3, Weld=True)

# ---- group: Remove Duplicate Faces and Make Sure Mesh is Healthy
weaverbird_s_unify_face_windings = WeaverbirdsUnifyFaceWindings(MeshCurves=weaverbird_s_join_meshes_and_weld)
mesh_weldvertices = MeshWeldVertices(Mesh=weaverbird_s_unify_face_windings, Tolerance=0.01)  # -> RuntimeMessage, Mesh

# ---- group: Make Thickness
weaverbird_s_mesh_thicken = WeaverbirdsMeshThicken(MeshCurves=mesh_weldvertices.Mesh, Distance=Slider(0.5, range=0..1), OffsetType=0)

# ---- group: Smooth!
smoothing_count = Slider(3, range=0..10)
weaverbird_s_catmull_clark_subdivision = WeaverbirdsCatmullClarkSubdivision(MeshCurves=weaverbird_s_mesh_thicken, Level=smoothing_count, SmoothNakedEdges=1)

# ----
custom_preview = CustomPreview(Geometry=weaverbird_s_catmull_clark_subdivision, Shader=ColourSwatch(SwatchColor=RGB(42, 168, 143)))
