# Grasshopper definition nesting.gh (Grasshopper 1.0.4)

# ---- group: Several Points for Galapagos to Control
number_slider = Slider(9, range=0..10)
number_slider_2 = Slider(6.7, range=0..10)
number_slider_3 = Slider(6.9, range=0..10)
number_slider_4 = Slider(4.2, range=0..10)
number_slider_5 = Slider(6.2, range=0..10)
number_slider_6 = Slider(7.9, range=0..10)
number_slider_7 = Slider(3.1, range=0..10)
number_slider_8 = Slider(2.1, range=0..10)
number_slider_9 = Slider(2.2, range=0..10)
number_slider_10 = Slider(6.5, range=0..10)
construct_point = ConstructPoint(XCoordinate=number_slider, YCoordinate=number_slider_2, ZCoordinate=0)
construct_point_2 = ConstructPoint(XCoordinate=number_slider_3, YCoordinate=number_slider_4, ZCoordinate=0)
construct_point_3 = ConstructPoint(XCoordinate=number_slider_5, YCoordinate=number_slider_6, ZCoordinate=0)
construct_point_4 = ConstructPoint(XCoordinate=number_slider_7, YCoordinate=number_slider_8, ZCoordinate=0)
construct_point_5 = ConstructPoint(XCoordinate=number_slider_9, YCoordinate=number_slider_10, ZCoordinate=0)

# ----
# Shapes to Nest
# 
# This definition only permits 5 shapes. Add more points and rotation parameters as needed for more shapes.
# 
# Right Click and "Set Mutiple Curves"
# |
# V
curve = Curve([<curve referenced from the Rhino model> x5])

# ---- group: Find centers of shapes
area = Area(Geometry=curve)  # -> Area, Centroid

# ----
point = Point([construct_point, construct_point_2, construct_point_3, construct_point_4, construct_point_5])

# ---- group: Move shape centers to Galapagos Points
vector_2pt = Vector2Pt(PointA=area.Centroid, PointB=point, Unitize=False)  # -> Vector, Length
move = Move(Geometry=curve, Motion=vector_2pt.Vector)  # -> Geometry, Transform

# ---- group: Random angles for Galapagos to Control
number_slider_11 = Slider(0.59, range=0..2)
number_slider_12 = Slider(0.92, range=0..2)
number_slider_13 = Slider(1.19, range=0..2)
number_slider_14 = Slider(0.58, range=0..2)
# There are 2*Pi radians in a circle, so allowing these sliders to go up to 2 gives Galapagos free rotation
number_slider_15 = Slider(0.47, range=0..2)
pi = Pi(Factor=number_slider_11)
pi_2 = Pi(Factor=number_slider_12)
pi_3 = Pi(Factor=number_slider_13)
pi_4 = Pi(Factor=number_slider_14)
pi_5 = Pi(Factor=number_slider_15)

# ---- group: Shape to fit inside
number_slider_16 = Slider(10, range=0..10)
rectangle = Rectangle(Plane=PlaneXY(0, 0, 0), XSize=number_slider_16, YSize=number_slider_16, Radius=0)  # -> Rectangle, Length

# ----
number = Number([pi, pi_2, pi_3, pi_4, pi_5])

# ---- group: Rotate Shapes
rotate = Rotate(Geometry=move.Geometry, Angle=number, Plane=point)  # -> Geometry, Transform

# ---- group: Check if the curves intersect one another
flatten_tree = FlattenTree(Tree=[rectangle.Rectangle, rotate.Geometry], Path="{0}")
multiple_curves = MultipleCurves(Curves=flatten_tree)  # -> Points, IndexA, IndexB, ParamA, ParamB

# ---- group: If shapes intersect, join them together. This will make their composite area smaller
region_union = RegionUnion(Curves=rotate.Geometry)
area_2 = Area(Geometry=region_union)  # -> Area, Centroid
mass_addition = MassAddition(Input=area_2.Area)  # -> Result, PartialResults

# ---- group: Positive Fitness: How much of the shapes fit in the rectangle?
region_intersection = RegionIntersection(CurvesA=rotate.Geometry, CurvesB=rectangle.Rectangle)
area_3 = Area(Geometry=region_intersection)  # -> Area, Centroid
mass_addition_2 = MassAddition(Input=area_3.Area)  # -> Result, PartialResults

# ---- group: Calculate combineed shape area
area_4 = Area(Geometry=rotate.Geometry)  # -> Area, Centroid
mass_addition_3 = MassAddition(Input=area_4.Area)  # -> Result, PartialResults

# ---- group: Negative Fitness: Do the shapes intersect one another?
# This multiplication is a penalization weight. We want the evolutionary system to really hate intersecting shapes!
number_slider_17 = Slider(50, range=0..100)
list_length = ListLength(List=multiple_curves.Points)
multiplication = Multiplication(A=list_length, B=number_slider_17)

# ---- group: Calculate how much overlapping area there is
subtraction = Subtraction(A=mass_addition_3.Result, B=mass_addition.Result)

# ---- group: Negative Fitness: Do the shapes overlap one another?
# This multiplication is a penalization weight. We want the evolutionary system to really hate overlapping area!
number_slider_18 = Slider(50, range=0..100)
multiplication_2 = Multiplication(A=subtraction, B=number_slider_18)

# ---- group: Join negative fitnesses
mass_addition_4 = MassAddition(Input=[multiplication, multiplication_2])  # -> Result, PartialResults

# ---- group: Composite Fitness Goal
subtraction_2 = Subtraction(A=mass_addition_2.Result, B=[multiplication, mass_addition_4.Result])

# ----
# Double click to run Galapagos!
galapagos = Galapagos(
    fitness=subtraction_2,
    gene=[number_slider_11, number_slider_12, number_slider_13, number_slider_14, number_slider_15, number_slider, number_slider_2, number_slider_3, number_slider_4, number_slider_5, number_slider_6, number_slider_7, number_slider_8, number_slider_9, number_slider_10])
