# Grasshopper definition subway.gh (Grasshopper 1.0.4)

# ---- group: Points for Galapagos
number_slider = Slider(7.57, range=0..10)
number_slider_2 = Slider(2.35, range=0..10)
number_slider_3 = Slider(7.59, range=0..10)
number_slider_4 = Slider(5.67, range=0..10)
number_slider_5 = Slider(6.09, range=0..10)
number_slider_6 = Slider(5.04, range=0..10)
number_slider_7 = Slider(4.59, range=0..10)
number_slider_8 = Slider(4.19, range=0..10)
number_slider_9 = Slider(3.91, range=0..10)
number_slider_10 = Slider(4.09, range=0..10)
number_slider_11 = Slider(3.35, range=0..10)
number_slider_12 = Slider(4.4, range=0..10)
number_slider_13 = Slider(5.2, range=0..10)
number_slider_14 = Slider(8.68, range=0..10)
number_slider_15 = Slider(1.91, range=0..10)
number_slider_16 = Slider(5.96, range=0..10)
number_slider_17 = Slider(3.34, range=0..10)
number_slider_18 = Slider(4.74, range=0..10)
construct_point = ConstructPoint(XCoordinate=number_slider, YCoordinate=number_slider_2, ZCoordinate=0)
construct_point_2 = ConstructPoint(XCoordinate=number_slider_3, YCoordinate=number_slider_4, ZCoordinate=0)
construct_point_3 = ConstructPoint(XCoordinate=number_slider_5, YCoordinate=number_slider_6, ZCoordinate=0)
construct_point_4 = ConstructPoint(XCoordinate=number_slider_7, YCoordinate=number_slider_8, ZCoordinate=0)
construct_point_5 = ConstructPoint(XCoordinate=number_slider_9, YCoordinate=number_slider_10, ZCoordinate=0)
construct_point_6 = ConstructPoint(XCoordinate=number_slider_11, YCoordinate=number_slider_12, ZCoordinate=0)
construct_point_7 = ConstructPoint(XCoordinate=number_slider_17, YCoordinate=number_slider_18, ZCoordinate=0)
construct_point_8 = ConstructPoint(XCoordinate=number_slider_13, YCoordinate=number_slider_14, ZCoordinate=0)
construct_point_9 = ConstructPoint(XCoordinate=number_slider_15, YCoordinate=number_slider_16, ZCoordinate=0)

# ---- group: Root Station
number_slider_19 = Slider(0, range=0..100)
construct_point_10 = ConstructPoint(XCoordinate=number_slider_19, YCoordinate=number_slider_19, ZCoordinate=0)

# ---- group: Subway Turn Points
polyline = PolyLine(
    Vertices=[construct_point_10, construct_point, construct_point_2, construct_point_3, construct_point_4, construct_point_5, construct_point_6, construct_point_7, construct_point_8, construct_point_9],
    Closed=False)

# ----
# Population Centers
# 
# Right Click and "Set Multiple Curves"
# |
# V
curve = Curve([<curve referenced from the Rhino model> x7])

# ---- group: Stations
point = Point([construct_point_10, construct_point, construct_point_2, construct_point_3, construct_point_4, construct_point_5, construct_point_6, construct_point_7, construct_point_8, construct_point_9])

# ----
curve_proximity = CurveProximity(CurveA=polyline, CurveB=curve)  # -> PointA, PointB, Distance

# ---- group: Negative Fitness: Does the Subway Self-Intersect?
curve_self = CurveSelf(Curve=polyline)  # -> Points, Params
list_length = ListLength(List=curve_self.Points)
multiplication = Multiplication(A=list_length, B=Slider(100, range=0..100))

# ---- group: Negative Fitness: Measure Angles of Subway Bend
explode = Explode(Curve=polyline, Recursive=True)  # -> Segments, Vertices
shift_list = ShiftList(List=explode.Segments, Shift=1, Wrap=False)
angle = Angle(VectorA=explode.Segments, VectorB=shift_list)  # -> Angle, Reflex
degrees = Degrees(Radians=angle.Angle)
mass_addition = MassAddition(Input=degrees)  # -> Result, PartialResults

# ---- group: Walking path visualization
line = Line(StartPoint=curve_proximity.PointA, EndPoint=curve_proximity.PointB)

# ---- group: Negative Fitness: Longer tracks are bad because construction is expensive!
length = Length(Curve=polyline)

# ---- group: Conditional: If the path to the subway is larger than a set walking distance, penalize the system considerably
walking_distance = Slider(1.12, range=0..10)
larger_than = LargerThan(FirstNumber=curve_proximity.Distance, SecondNumber=walking_distance)  # -> LargerThan, OrEqualTo
multiplication_2 = Multiplication(A=Slider(100, range=0..100), B=larger_than.LargerThan)

# ---- group: Gather and add up all fitness parameters
mass_addition_2 = MassAddition(Input=flatten([length, multiplication, curve_proximity.Distance, multiplication_2, mass_addition.Result]))  # -> Result, PartialResults

# ----
# Double-Click to Run Galapagos.
# 
# Make sure you set it to "Minimize" in this example, as all fitnesses are inverted.
galapagos = Galapagos(
    fitness=mass_addition_2,
    gene=[number_slider, number_slider_2, number_slider_3, number_slider_4, number_slider_5, number_slider_6, number_slider_7, number_slider_8, number_slider_9, number_slider_10, number_slider_11, number_slider_12, number_slider_17, number_slider_18, number_slider_13, number_slider_14, number_slider_15, number_slider_16])
