# Grasshopper definition catenary.gh (Grasshopper 1.0.4)
# plug-ins: Kangaroo Components

# ---- group: Shape of Fabric
rectangle = Rectangle(Plane=PlaneXY(0, 0, 0), XSize=Slider(10, range=0..10), YSize=Slider(6, range=0..10), Radius=0)  # -> Rectangle, Length

# ---- group: Make Mesh Patch
mesh_plane = MeshPlane(Boundary=rectangle.Rectangle, WidthCount=10, HeightCount=10)  # -> Mesh, Area

# ---- group: Use Corners of Rectangle as Anchored Points
discontinuity = Discontinuity(Curve=rectangle.Rectangle, Level=1)  # -> Points, Parameters

# ---- group: Force Upwards and Downwards
deconstruct_mesh = DeconstructMesh(Mesh=mesh_plane.Mesh)  # -> Vertices, Faces, Colours, Normals
unit_z = UnitZ(Factor=Slider(0, range=-10..10))
unaryforce = UnaryForce(Point=deconstruct_mesh.Vertices, Force=unit_z)

# ---- group: Hold Form Together and Determine Elasticicty of Material
springsfrommesh = SpringsFromMesh(M=mesh_plane.Mesh, stiffness=1000, B=Slider(1, range=0..2))

# ---- group: Core Kangaroo Setup
timer = Timer(TimerInterval=50, Target=kangaroophysics)  # disabled
kangaroophysics = KangarooPhysics(
    ForceObjects=flatten([springsfrommesh, unaryforce]),
    AnchorPoints=discontinuity.Points,
    Settings=null,
    Geometry=mesh_plane.Mesh,
    SimulationReset=Toggle(True))  # -> Out, Iterations, ParticlesOut, GeometryOut, KE

# ----
mesh = Mesh(kangaroophysics.GeometryOut)
custom_preview = CustomPreview(Geometry=mesh, Shader=ColourSwatch(SwatchColor=RGB(91, 207, 207)))

# ==== cluster SpringsFromMesh: Turns all edges of a mesh into springs
M = ClusterInput()
medges = MeshEdges(Mesh=M)  # -> NakedEdges, InteriorEdges, NonManifoldEdges
crv = Curve([medges.NakedEdges, medges.InteriorEdges])
B = ClusterInput()
len = Length(Curve=crv)
multiplication = Multiplication(A=len, B=B)
stiffness = ClusterInput()
springs = SpringsFromLine(Connection=crv, Stiffness=stiffness, Damping=10, RestLength=multiplication, UpperCutoff=0, LowerCutoff=0, Plasticity=0)
S = ClusterOutput(springs)
