# Grasshopper definition inflate.gh (Grasshopper 1.0.4)
# plug-ins: Kangaroo Components, Kangaroo2 Components

# ---- group: Make mesh from closed polyline
curve = Curve(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)
boundary_surfaces = BoundarySurfaces(Edges=curve)
mesh_brep = MeshBrep(
    Brep=boundary_surfaces,
    Settings={GridMaxCount=0, GridMinCount=16, JaggedSeams=False, MaxEdgeLength=0, MinEdgeLength=0.0001, MinTolerance=0, Refine=True, RefineAngle=0, RelativeTolerance=0.65, SimplePlanes=True, Tolerance=0})

# ---- group: Add more faces to mesh
refine = Refine(Mesh=mesh_brep, Level=Slider(2, range=0..10))

# ---- group: Find which points are not border vertices
nakedvertices = NakedVertices(Mesh=refine)  # -> ClothedIndex, NakedIndex, ClothedPts, NakedPts
deconstruct_mesh = DeconstructMesh(Mesh=refine)  # -> Vertices, Faces, Colours, Normals
list_item = ListItem(List=deconstruct_mesh.Vertices, Index=nakedvertices.ClothedIndex, Wrap=True)

# ---- group: Shift inner vertices upwards
unit_z = UnitZ(Factor=Slider(0.25, range=0..1))
move = Move(Geometry=list_item, Motion=unit_z)  # -> Geometry, Transform

# ---- group: Rebuild mesh with moved vertices
replace_items = ReplaceItems(List=deconstruct_mesh.Vertices, Item=move.Geometry, Indices=nakedvertices.ClothedIndex, Wrap=False)
construct_mesh = ConstructMesh(Vertices=replace_items, Faces=deconstruct_mesh.Faces)

# ---- group: Mirror mesh and glue it together with the original
xy_plane = XYPlane(Origin=Point(0, 0, 0))
mirror = Mirror(Geometry=construct_mesh, Plane=xy_plane)  # -> Geometry, Transform
combine_clean = CombineClean(Meshes=[mirror.Geometry, construct_mesh])

# ---- group: Hold Mesh together, and allow elasticiity
springsfrommesh = SpringsFromMesh(M=flatten(combine_clean), stiffness=1000, B=Slider(1, range=0..10))

# ---- group: Inflate the mesh
meshpressure = MeshPressure(M=combine_clean, pressurelevel=Slider(501, range=0..1000))

# ---- group: Core Kangaroo
timer = Timer(TimerInterval=20, Target=kangaroophysics)  # disabled
kangaroophysics = KangarooPhysics(
    ForceObjects=flatten([meshpressure, springsfrommesh]),
    Settings=null,
    Geometry=combine_clean,
    SimulationReset=Toggle(True))  # -> Out, Iterations, ParticlesOut, GeometryOut, KE

# ----
custom_preview = CustomPreview(
    Geometry=kangaroophysics.GeometryOut,
    Shader={ambient=RGB(0, 0, 0), diffuse=RGB(255, 105, 180), emission=RGB(76, 32, 54), shine=0.5, specular=RGB(255, 255, 255), transparency=0})

# ==== cluster MeshPressure: Applies pressure to a triangulated mesh
M = ClusterInput()
mcomp = Decompose(Mesh=M)  # -> Vertices, Faces, Colours, Normals
vertices = FaceVertices(Face=mcomp.Faces)  # -> CornerA, CornerB, CornerC, CornerD
item = ListItem(List=mcomp.Vertices, Index=vertices.CornerA, Wrap=False)
item_2 = ListItem(List=mcomp.Vertices, Index=vertices.CornerB, Wrap=False)
item_3 = ListItem(List=mcomp.Vertices, Index=vertices.CornerC, Wrap=False)
pressurelevel = ClusterInput()
pressure = Pressure(Point1=item, Point2=item_2, Point3=item_3, PressureLevel=pressurelevel)
P = ClusterOutput(pressure)

# ==== cluster SpringsFromMesh: Turns all edges of a mesh into springs
M = ClusterInput()
medges = MeshEdges(Mesh=M)  # -> NakedEdges, InteriorEdges, NonManifoldEdges
crv = Curve([medges.NakedEdges, medges.InteriorEdges])
B = ClusterInput()
len = Length(Curve=crv)
multiplication = Multiplication(A=len, B=B)
stiffness = ClusterInput()
springs = SpringsFromLine(Connection=crv, Stiffness=stiffness, Damping=10, RestLength=multiplication, UpperCutoff=0, LowerCutoff=0, Plasticity=0)
S = ClusterOutput(springs)
