# Grasshopper definition orbit.gh (Grasshopper 1.0.4)
# plug-ins: Kangaroo Components

construct_point = ConstructPoint(XCoordinate=Slider(20, range=0..100), YCoordinate=Slider(0, range=0..100), ZCoordinate=Slider(0, range=0..100))
number_slider = Slider(5, range=0..1000)
vector_xyz = VectorXYZ(XComponent=Slider(0, range=0..10), YComponent=Slider(1, range=0..10), ZComponent=Slider(0, range=0..10))  # -> Vector, Length
particle = Particle(Point=construct_point, Mass=number_slider, Velocity=vector_xyz.Vector)

# ---- group: Planet 1 / Starting Speed
vector_xyz_2 = VectorXYZ(XComponent=Slider(0, range=0..10), YComponent=Slider(0, range=0..10), ZComponent=Slider(0, range=0..10))  # -> Vector, Length

# ---- group: Planet 1
construct_point_2 = ConstructPoint(XCoordinate=Slider(0, range=0..10), YCoordinate=Slider(0, range=0..10), ZCoordinate=Slider(0, range=0..10))
number_slider_2 = Slider(36, range=0..1000)
particle_2 = Particle(Point=construct_point_2, Mass=number_slider_2, Velocity=vector_xyz_2.Vector)

# ---- group: Power Law Force
line = Line(StartPoint=construct_point_2, EndPoint=construct_point)
powerlaw = PowerLaw(Connection=line, Exponent=-1, Strength=-5, Cutoff=0)

# ---- group: Slight alteration so there is more friction
kangaroo_settings = KangarooSettings(
    Tolerance=0.001,
    TimeStep=0.01,
    SubIterations=10,
    Floor=False,
    Drag=".01",
    Restitution=0.7,
    StaticFriction=10,
    KineticFriction=10,
    Settle=2,
    Tumble=1,
    Sound=False,
    Solver=0)

# ---- group: Core Grasshopper
boolean_toggle = BooleanToggle(True)
timer = Timer(TimerInterval=20, Target=kangaroophysics)  # disabled
kangaroophysics = KangarooPhysics(ForceObjects=[particle_2, particle, powerlaw], Settings=kangaroo_settings, SimulationReset=boolean_toggle)  # -> Out, Iterations, ParticlesOut, GeometryOut, KE

# ---- group: Adjust mass so it works better as a radius
number_slider_3 = Slider(0.1, range=0..1)
multiplication = Multiplication(A=number_slider_2, B=number_slider_3)
multiplication_2 = Multiplication(A=number_slider, B=number_slider_3)

# ---- group: Draw Planet
list_item = ListItem(List=kangaroophysics.ParticlesOut, Index=0, Wrap=True)
circle_cnr = CircleCNR(Center=list_item, Normal=Vector(0, 0, 1), Radius=multiplication)

list_item_2 = ListItem(List=kangaroophysics.ParticlesOut, Index=1, Wrap=True)
circle_cnr_2 = CircleCNR(Center=list_item_2, Normal=Vector(0, 0, 1), Radius=multiplication_2)

# ---- group: Keep track of path
trail = Trail(Points=kangaroophysics.ParticlesOut, Reset=boolean_toggle, Record=True)
