# Grasshopper definition vortextwist.gh (Grasshopper 1.0.4)
# plug-ins: Kangaroo Components

# ---- group: Make mesh plane
number_slider = Slider(10, range=0..10)
rectangle = Rectangle(Plane=PlaneXY(0, 0, 0), XSize=number_slider, YSize=number_slider, Radius=0)  # -> Rectangle, Length
mesh_plane = MeshPlane(Boundary=rectangle.Rectangle, WidthCount=10, HeightCount=10)  # -> Mesh, Area

# ---- group: Define axis of rotation
construct_point = ConstructPoint(XCoordinate=Slider(5, range=0..10), YCoordinate=Slider(5, range=0..10), ZCoordinate=0)
construct_point_2 = ConstructPoint(XCoordinate=Slider(5, range=0..10), YCoordinate=Slider(5, range=0..10), ZCoordinate=Slider(10, range=0..10))
line = Line(StartPoint=construct_point, EndPoint=construct_point_2)

# ---- group: Get vertices of mesh
deconstruct_mesh = DeconstructMesh(Mesh=mesh_plane.Mesh)  # -> Vertices, Faces, Colours, Normals

# ---- group: Draw circle, find which mesh vertices are within that circle, and anchor them
area = Area(Geometry=rectangle.Rectangle)  # -> Area, Centroid
circle_cnr = CircleCNR(Center=area.Centroid, Normal=Vector(0, 0, 1), Radius=Slider(1.6, range=0..10))
point_in_curve = PointInCurve(Point=deconstruct_mesh.Vertices, Curve=circle_cnr)  # -> Relationship, Point
cull_pattern = CullPattern(List=deconstruct_mesh.Vertices, CullPattern=point_in_curve.Relationship)

# ---- group: Vortex Force and Falloff Slider
vortex = Vortex(
    AxisStart=construct_point,
    AxisEnd=construct_point_2,
    Point=deconstruct_mesh.Vertices,
    Strength=100,
    Cutoff=0,
    Exponent=Slider(-3, range=-10..0))

# ---- group: Force of Gravity Inverted
gravity = Gravity(M=mesh_plane.Mesh, F=Slider(2.3, range=0..10))

# ---- group: Hold mesh together
springsfrommesh = SpringsFromMesh(M=mesh_plane.Mesh, stiffness=1000, B=1)

# ---- group: Core Kangaroo
timer = Timer(TimerInterval=20, Target=kangaroophysics)  # disabled
kangaroophysics = KangarooPhysics(
    ForceObjects=flatten([springsfrommesh, vortex, gravity]),
    AnchorPoints=cull_pattern,
    Settings=null,
    Geometry=mesh_plane.Mesh,
    SimulationReset=Toggle(True))  # -> Out, Iterations, ParticlesOut, GeometryOut, KE

# ---- group: Preview deformed mesh
mesh = Mesh(kangaroophysics.GeometryOut)
custom_preview = CustomPreview(Geometry=mesh, Shader=ColourSwatch(SwatchColor=RGB(255, 117, 156)))

# ==== cluster SpringsFromMesh: Turns all edges of a mesh into springs
M = ClusterInput()
medges = MeshEdges(Mesh=M)  # -> NakedEdges, InteriorEdges, NonManifoldEdges
crv = Curve([medges.NakedEdges, medges.InteriorEdges])
B = ClusterInput()
len = Length(Curve=crv)
multiplication = Multiplication(A=len, B=B)
stiffness = ClusterInput()
springs = SpringsFromLine(Connection=crv, Stiffness=stiffness, Damping=10, RestLength=multiplication, UpperCutoff=0, LowerCutoff=0, Plasticity=0)
S = ClusterOutput(springs)

# ==== cluster Gravity: Apply gravity to vertices of a mesh
M = ClusterInput()
F = ClusterInput()
mcomp = Decompose(Mesh=M)  # -> Vertices, Faces, Colours, Normals
Z = UnitZ(Factor=F)
duppt = RemoveDuplicatePts(Points=mcomp.Vertices, Tolerance=0.01)
uforce = UnaryForce(Point=duppt, Force=Z)
U = ClusterOutput(uforce)
