# Grasshopper definition wind.gh (Grasshopper 1.0.4)
# plug-ins: Kangaroo Components

# ---- group: Make Rectangle on Front Plane
xz_plane = XZPlane(Origin=Point(0, 0, 0))
rectangle = Rectangle(Plane=xz_plane, XSize=Slider(10, range=0..10), YSize=Slider(5, range=0..10), Radius=0)  # -> Rectangle, Length

# ---- group: Find 2 Corners of Rect to Anchor Flag
discontinuity = Discontinuity(Curve=rectangle.Rectangle, Level=1)  # -> Points, Parameters
list_item = ListItem(List=discontinuity.Points, Index=3, Wrap=True)
list_item_2 = ListItem(List=discontinuity.Points, Index=0, Wrap=True)

# ---- group: Make mesh plane
mesh_plane = MeshPlane(Boundary=rectangle.Rectangle, WidthCount=10, HeightCount=10)  # -> Mesh, Area

# ---- group: Model Flag Pole
line = Line(StartPoint=list_item_2, EndPoint=list_item)
pipe = Pipe(Curve=line, Radius=Slider(0.25, range=0..1), Caps=2)
custom_preview = CustomPreview(Geometry=pipe, Shader=ColourSwatch(SwatchColor=RGB(191, 165, 50)))

# ---- group: Force and Direction of Wind Force
vector_xyz = VectorXYZ(XComponent=Slider(0, range=-10..10), YComponent=Slider(-5, range=-10..10), ZComponent=Slider(0, range=-10..10))  # -> Vector, Length
windmesh = WindMesh(M=mesh_plane.Mesh, wind=vector_xyz.Vector, relative=True, strength=1, waterline=0)

# ---- group: Hold Mesh Together
springsfrommesh = SpringsFromMesh(M=mesh_plane.Mesh, stiffness=1000, B=1)

# ---- group: Core Kangaroo
boolean_toggle = BooleanToggle(True)
timer = Timer(TimerInterval=20, Target=kangaroophysics)
kangaroophysics = KangarooPhysics(
    ForceObjects=flatten([springsfrommesh, windmesh]),
    AnchorPoints=[list_item_2, list_item],
    Settings=null,
    Geometry=mesh_plane.Mesh,
    SimulationReset=boolean_toggle)  # -> Out, Iterations, ParticlesOut, GeometryOut, KE

# ---- group: Preview simulated mesh
mesh = Mesh(kangaroophysics.GeometryOut)
custom_preview_2 = CustomPreview(Geometry=mesh, Shader=ColourSwatch(SwatchColor=RGB(178, 145, 255)))

# ----
trail = Trail(Points=kangaroophysics.ParticlesOut, Reset=boolean_toggle, Record=True)

# ==== cluster WindMesh: Applies wind to a mesh
M = ClusterInput()
mcomp = Decompose(Mesh=M)  # -> Vertices, Faces, Colours, Normals
vertices = FaceVertices(Face=mcomp.Faces)  # -> CornerA, CornerB, CornerC, CornerD
item = ListItem(List=mcomp.Vertices, Index=vertices.CornerA, Wrap=False)
item_2 = ListItem(List=mcomp.Vertices, Index=vertices.CornerB, Wrap=False)
item_3 = ListItem(List=mcomp.Vertices, Index=vertices.CornerC, Wrap=False)
wind = ClusterInput()
relative = ClusterInput()
strength = ClusterInput()
waterline = ClusterInput()
wind_2 = Wind(Point1=item, Point2=item_2, Point3=item_3, Wind=wind, Relative=relative, Strength=strength, Waterline=waterline)
W = ClusterOutput(wind_2)

# ==== cluster SpringsFromMesh: Turns all edges of a mesh into springs
M = ClusterInput()
medges = MeshEdges(Mesh=M)  # -> NakedEdges, InteriorEdges, NonManifoldEdges
crv = Curve([medges.NakedEdges, medges.InteriorEdges])
B = ClusterInput()
len = Length(Curve=crv)
multiplication = Multiplication(A=len, B=B)
stiffness = ClusterInput()
springs = SpringsFromLine(Connection=crv, Stiffness=stiffness, Damping=10, RestLength=multiplication, UpperCutoff=0, LowerCutoff=0, Plasticity=0)
S = ClusterOutput(springs)
