# Grasshopper definition audio.gh (Grasshopper 1.0.4)

harder_better_faster_stronger = Panel("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")
text_split = TextSplit(Text=harder_better_faster_stronger, Separators=",")
number = Number(text_split)

# ---- group: Throw Away 3 out of 4 Samples
panel = Panel("""1
0
0
0""")
dispatch = Dispatch(List=number, DispatchPattern=panel)  # -> ListA, ListB

# ---- group: Scale Data
multiplication = Multiplication(A=dispatch.ListA, B=Slider(0.02, range=0..1))

# ---- group: Create Evenly Spaced Values
list_length = ListLength(List=dispatch.ListA)
range = Range(Domain=Slider(31, range=0..100), Steps=list_length)

# ---- group: Draw Profile
construct_point = ConstructPoint(XCoordinate=0, YCoordinate=range, ZCoordinate=multiplication)
nurbs_curve = NurbsCurve(Vertices=construct_point, Degree=3, Periodic=False)  # -> Curve, Length, Domain

# ---- group: Revolution Axis
construct_point_2 = ConstructPoint(XCoordinate=0, YCoordinate=0, ZCoordinate=0)
line_sdl = LineSDL(Start=construct_point_2, Direction=Vector(0, 0, 1), Length=1)

# ----
revolution = Revolution(Curve=nurbs_curve.Curve, Axis=line_sdl, Domain=Domain(0, 6.283185307))
custom_preview = CustomPreview(Geometry=revolution, Shader=ColourSwatch(SwatchColor=RGB(161, 134, 45)))
