# Grasshopper definition bra_pattern.gh (Grasshopper 1.0.4)

# ---- group: Cup / Triangle for Under-Breast Curvature
polygon = Polygon(Plane=PlaneXY(0, 0, 0), Radius=Slider(3.6, range=0..10), Segments="3", FilletRadius=0)  # -> Polygon, Length
rotate = Rotate(Geometry=polygon.Polygon, Angle=4.71238898, Plane=PlaneXY(0, 0, 0))  # -> Geometry, Transform

# ---- group: Inter-Breast Cradle / Cradle Bottom Line
construct_point = ConstructPoint(XCoordinate=0, YCoordinate=0, ZCoordinate=0)
unit_x = UnitX(Factor=1)
line_sdl = LineSDL(Start=construct_point, Direction=unit_x, Length=Slider(5.7, range=0..10))

# ----
panel = Panel("""Bake This!

|
|
V""")

# ---- group: Cup
explode = Explode(Curve=rotate.Geometry, Recursive=True)  # -> Segments, Vertices

# ---- group: Cup / Draw Curve along Triangle Edge
list_item = ListItem(List=explode.Segments, Index=2, Wrap=True)
unit_y = UnitY(Factor=Slider(2.8, range=0..10))
unit_x_2 = UnitX(Factor=Slider(0.6, range=0..10))
end_points = EndPoints(Curve=list_item)  # -> Start, End
negative = Negative(Value=unit_x_2)
negative_2 = Negative(Value=unit_y)
bezier_span = BezierSpan(StartPoint=end_points.Start, StartTangent=negative_2, EndPoint=end_points.End, EndTangent=negative)  # -> Curve, Length, Domain

list_item_2 = ListItem(List=explode.Segments, Index=0, Wrap=True)
unit_y_2 = UnitY(Factor=Slider(3.4, range=0..10))
unit_x_3 = UnitX(Factor=Slider(1.2, range=0..10))
end_points_2 = EndPoints(Curve=list_item_2)  # -> Start, End
negative_3 = Negative(Value=unit_y_2)
bezier_span_2 = BezierSpan(StartPoint=end_points_2.Start, StartTangent=unit_x_3, EndPoint=end_points_2.End, EndTangent=negative_3)  # -> Curve, Length, Domain

# ---- group: Cup / Shoulder Point
vector_xyz = VectorXYZ(XComponent=Slider(3.1, range=0..10), YComponent=Slider(7.1, range=0..10), ZComponent=0)  # -> Vector, Length
move = Move(Geometry=end_points_2.End, Motion=vector_xyz.Vector)  # -> Geometry, Transform

# ---- group: Inter-Breast Cradle
end_points_3 = EndPoints(Curve=line_sdl)  # -> Start, End

# ---- group: Inter-Breast Cradle / Underwire Section Height
number_slider = Slider(0.7, range=0..1)
unit_y_3 = UnitY(Factor=1)
line_sdl_2 = LineSDL(Start=end_points_3.End, Direction=unit_y_3, Length=number_slider)

# ---- group: Inter-Breast Cradle / Cradle Coverage Height
unit_y_4 = UnitY(Factor=1)
line_sdl_3 = LineSDL(Start=end_points_3.Start, Direction=unit_y_4, Length=Slider(5, range=0..10))

# ---- group: Wing
construct_point_2 = ConstructPoint(XCoordinate=0, YCoordinate=0, ZCoordinate=0)

# ---- group: Wing / Wing Length
unit_x_4 = UnitX(Factor=1)
line_sdl_4 = LineSDL(Start=construct_point_2, Direction=unit_x_4, Length=Slider(15.5, range=0..100))

# ---- group: Wing / Underwire Height
unit_y_5 = UnitY(Factor=1)
line_sdl_5 = LineSDL(Start=construct_point_2, Direction=unit_y_5, Length=number_slider)

# ---- group: Inter-Breast Cradle (continued)
end_points_4 = EndPoints(Curve=line_sdl_3)  # -> Start, End
end_points_5 = EndPoints(Curve=line_sdl_2)  # -> Start, End

# ---- group: Inter-Breast Cradle / Inter-Breast Radius
unit_x_5 = UnitX(Factor=1)
line_sdl_6 = LineSDL(Start=end_points_4.End, Direction=unit_x_5, Length=Slider(0.7, range=0..1))

# ---- group: Inter-Breast Cradle (continued)
end_points_6 = EndPoints(Curve=line_sdl_6)  # -> Start, End

# ---- group: Inter-Breast Cradle / Cradle Curve
unit_y_6 = UnitY(Factor=Slider(4.4, range=0..10))
unit_x_6 = UnitX(Factor=Slider(2.2, range=0..10))
negative_4 = Negative(Value=unit_y_6)
negative_5 = Negative(Value=unit_x_6)
bezier_span_3 = BezierSpan(StartPoint=end_points_6.End, StartTangent=negative_4, EndPoint=end_points_5.End, EndTangent=negative_5)  # -> Curve, Length, Domain

# ---- group: Inter-Breast Cradle / Cradle
join_curves = JoinCurves(Curves=flatten([bezier_span_3.Curve, line_sdl_6, line_sdl_3, line_sdl_2, line_sdl]), Preserve=False)

# ---- group: Inter-Breast Cradle / Shift Cradle to the Left
unit_x_7 = UnitX(Factor=Slider(13, range=0..100))
negative_6 = Negative(Value=unit_x_7)
move_2 = Move(Geometry=join_curves, Motion=negative_6)  # -> Geometry, Transform

# ---- group: Wing / Armpit Point
vector_xyz_2 = VectorXYZ(XComponent=Slider(4.3, range=0..10), YComponent=Slider(4.3, range=0..10), ZComponent=0)  # -> Vector, Length

# ---- group: Wing (continued)
end_points_7 = EndPoints(Curve=line_sdl_5)  # -> Start, End
end_points_8 = EndPoints(Curve=line_sdl_4)  # -> Start, End

# ---- group: Wing / Clasp Height
unit_y_7 = UnitY(Factor=1)
line_sdl_7 = LineSDL(Start=end_points_8.End, Direction=unit_y_7, Length=Slider(1, range=0..10))

# ---- group: Wing / Armpit Point (continued)
move_3 = Move(Geometry=end_points_7.End, Motion=vector_xyz_2.Vector)  # -> Geometry, Transform

# ---- group: Wing / Wing Cradle Curve
negative_7 = Negative(Value=Slider(1.8, range=0..10))
unit_x_8 = UnitX(Factor=Slider(3.6, range=0..10))
unit_y_8 = UnitY(Factor=negative_7)
bezier_span_4 = BezierSpan(StartPoint=end_points_7.End, StartTangent=unit_x_8, EndPoint=move_3.Geometry, EndTangent=unit_y_8)  # -> Curve, Length, Domain

# ---- group: Wing (continued)
end_points_9 = EndPoints(Curve=line_sdl_7)  # -> Start, End

# ---- group: Wing / Armpit->Clasp Curve
unit_y_9 = UnitY(Factor=Slider(1.8, range=0..10))
unit_x_9 = UnitX(Factor=Slider(4.7, range=0..10))
negative_8 = Negative(Value=unit_y_9)
negative_9 = Negative(Value=unit_x_9)
bezier_span_5 = BezierSpan(StartPoint=move_3.Geometry, StartTangent=negative_8, EndPoint=end_points_9.End, EndTangent=negative_9)  # -> Curve, Length, Domain

# ---- group: Wing / Join All Curve Together
join_curves_2 = JoinCurves(Curves=[bezier_span_4.Curve, bezier_span_5.Curve, line_sdl_7, line_sdl_5, line_sdl_4], Preserve=False)

# ---- group: Wing / Shift Wing to Right
unit_x_10 = UnitX(Factor=Slider(12, range=0..100))
move_4 = Move(Geometry=join_curves_2, Motion=unit_x_10)  # -> Geometry, Transform

# ----
length = Length(Curve=bezier_span.Curve)
length_2 = Length(Curve=bezier_span_4.Curve)
subtraction = Subtraction(A=length, B=length_2)

# ----
# Difference betweem Mating Pattern Curves between Cup and Wing.
# 
# A Perfectly Sewable Pattern will Show "0"
panel_2 = Panel(subtraction)

# ---- group: Cup (continued)
join_curves_3 = JoinCurves(Curves=flatten([bezier_span_2.Curve, bezier_span.Curve]), Preserve=False)

# ---- group: Cup / Coverage Extension
number_slider_2 = Slider(1.9, range=0..10)
extend_curve = ExtendCurve(Curve=join_curves_3, Type=1, Start=number_slider_2, End=0)

# ---- group: Cup / Mirror Second Triangle
yz_plane = YZPlane(Origin=end_points_2.End)
mirror = Mirror(Geometry=join_curves_3, Plane=yz_plane)  # -> Geometry, Transform

# ---- group: Cup (continued)
join_curves_4 = JoinCurves(Curves=[extend_curve, mirror.Geometry], Preserve=False)
end_points_10 = EndPoints(Curve=join_curves_4)  # -> Start, End

# ---- group: Cup / Shoulder->Armpit Curve
unit_x_11 = UnitX(Factor=Slider(3.4, range=0..10))
unit_y_10 = UnitY(Factor=Slider(0, range=0..10))
negative_10 = Negative(Value=unit_y_10)
negative_11 = Negative(Value=unit_x_11)
bezier_span_6 = BezierSpan(StartPoint=move.Geometry, StartTangent=negative_10, EndPoint=end_points_10.End, EndTangent=negative_11)  # -> Curve, Length, Domain

# ---- group: Cup / Top of Cup Line
line = Line(StartPoint=move.Geometry, EndPoint=end_points_10.Start)

# ---- group: Cup / Join all Curves
join_curves_5 = JoinCurves(Curves=flatten([bezier_span_6.Curve, line, join_curves_4]), Preserve=False)

# ---- group: Calculate Curve Differential
length_3 = Length(Curve=bezier_span.Curve)
length_4 = Length(Curve=bezier_span_3.Curve)
addition = Addition(A=number_slider_2, B=length_3)
subtraction_2 = Subtraction(A=length_4, B=addition)

# ----
curve = Curve([move_2.Geometry, join_curves_5, move_4.Geometry])
# Difference betweem Mating Pattern Curves between Cup and Inter-Breast Cradle.
# 
# A Perfectly Sewable Pattern will Show "0"
panel_3 = Panel(subtraction_2)
