# Grasshopper definition dataloft.gh (Grasshopper 1.0.4)

number_of_samples = Slider(24, range=0..100)
overall_scale = Slider(2, range=0..10)

# ---- group: Generate sequence of numbers
loft_length = Slider(18, range=0..100)
range = Range(Domain=loft_length, Steps=number_of_samples)

# ---- group: Make 'Data-Driven' Polygons
random = Random(Range=overall_scale, Number=number_of_samples, Seed=2)
random_2 = Random(Range=overall_scale, Number=number_of_samples, Seed=24)
random_3 = Random(Range=overall_scale, Number=number_of_samples, Seed=232)
random_4 = Random(Range=overall_scale, Number=number_of_samples, Seed=255)
negative = Negative(Value=random_4)
negative_2 = Negative(Value=random_3)
construct_point = ConstructPoint(XCoordinate=random, YCoordinate=range, ZCoordinate=0)
construct_point_2 = ConstructPoint(XCoordinate=0, YCoordinate=range, ZCoordinate=random_2)
construct_point_3 = ConstructPoint(XCoordinate=negative, YCoordinate=range, ZCoordinate=0)
construct_point_4 = ConstructPoint(XCoordinate=0, YCoordinate=range, ZCoordinate=negative_2)

# ---- group: Join all Points into Single List
panel = Panel("""0
1
2
3""")
weave = Weave(
    Pattern=panel,
    Stream0=construct_point,
    Stream1=construct_point_2,
    Stream2=construct_point_3,
    Stream3=construct_point_4,
    NullGaps=False)

# ---- group: Cut List into Groups of 4 Points
partition_list = PartitionList(List=weave, Size=4)

# ---- group: Draw Shapes
polyline = PolyLine(Vertices=partition_list, Closed=True)

# ---- group: Connect Cross-Sections as Surface
flatten_tree = FlattenTree(Tree=polyline, Path="{0}")
loft = Loft(Curves=flatten_tree, Options={Adjust=False, Closed=False, LoftEnds=0, LoftSimp=0, LoftType=0, Rebuild=10, Refit=0.01})
cap_holes = CapHoles(Brep=loft)

# ----
custom_preview = CustomPreview(Geometry=cap_holes, Shader=ColourSwatch(SwatchColor=RGB(166, 80, 46)))
