# Grasshopper definition maps.gh (Grasshopper 1.0.4)
# Copyright: Co-de-iT

geojson_file = Panel("""{
"type": "FeatureCollection",
"crs": { "type": "name", "properties": { "name": "urn:ogc:def:crs:OGC:1.3:CRS84" } },
"features": [
{ "type": "Feature", "properties": { "OBJECTID": 1, "ASSET_ID": 21100001, "LINES": "Blue Line (Forest Park)", "DESCRIPTIO": "Oak Park to Austin", "TYPE": 2, "LEGEND": "BL", "ALT_LEGEND": "BL", "BRANCH": "Blue Line Forest Park", "SHAPE_LEN": 4060.36877766 }, "geometry": { "type": "LineString", "coordinates": [ [ -87.791602149258892, 41.872107973735893 ], [ -87.787236916593315, 41.871723912851543 ], [ -87.784182945884282, 41.871450556138321 ], [ -87.782515834393465, 41.871301300845296 ], [ -87.778262341506135, 41.870978202157424 ], [ -87.776785269649608, 41.87088639396714 ] ] } },
{ "type": "Feature", "properties": { "OBJECTID": 10, "ASSET_ID": 21100010, "LINES": "Blue Line (Forest Park)", "DESCRIPTIO": "Western to Medical District", "TYPE": 2, "LEGEND": "BL", "ALT_LEGEND": "BL", "BRANCH": "Blue Line Forest Park", "SHAPE_LEN": 3946.19646453 }, "geometry": { "type": "LineString", "coordinates": [ [ -87.688434511439723, 41.87552957420619 ], [ -87.687027774003653, 41.875538280824131 ], [ -87.686128871721422, 41.875545129154943 ], [ -87.680267950480385, 41.875580792645124 ], [ -87.676451409793671, 41.87560929112351 ], [ -87.673945880112313, 41.875635428997192 ] ] } },
{ "type": "Feature", "properties": { "OBJECTID": 19, "ASSET_ID": 21100019, "LINES": "Blue Line (O'Hare)", "DESCRIPTIO": "Monroe to Jackson", "TYPE": 1, "LEGEND": "BL", "ALT_LEGEND": "BL", "BRANCH": "Blue Line Dearborn Subway", "SHAPE_LEN": 918.93188786500002 }, "geometry": { "type": "LineString", "coordinates": [ [ -87.629377699921633, 41.880703460008618 ], [ -87.629338700098103, 41.879497546906116 ], [ -87.629323758717845, 41.879035529526554 ], [ -87.629313709672388, 41.878730388135466 ], [ -87.629296222507364, 41.878199558079032 ], [ -87.629295664106792, 41.878182517687662 ] ] } },
{ "type": "Feature", "properties": { "OBJECTID": 24, "ASSET_ID": 21100024, "LINES": "Blue Line (Forest Park)", "DESCRIPTIO": "Harlem to Oak Park", "TYPE": 2, "LEGEND": "BL", "ALT_LEGEND": "BL", "BRANCH": "Blue Line Forest Park", "SHAPE_LEN": 4213.4136622899996 }, "geometry": { "type": "LineString", "coordinates": [ [ -87.80696087211642, 41.873490050720811 ], [ -87.805687072064217, 41.873363167293107 ], [ -87.804483350824142, 41.87324883404429 ], [ -87.801517605675059, 41.872967085826659 ], [ -87.796354436721259, 41.872506850844147 ], [ -87.792790153481377, 41.872212465847838 ], [ -87.791602149258892, 41.872107973735893 ] ] } },
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""")
geojson_to_polyline_1_1 = GeoJSONToPolyline11(J=geojson_file)  # -> doc_2, P_2, K_3, V_3
# Available Data per Geo Entity
panel = Panel(geojson_to_polyline_1_1.V_3)
panel_2 = Panel(geojson_to_polyline_1_1.K_3)
panel_3 = Panel("Available Data Name")

# ---- group: Get Item of Interest
list_item = ListItem(List=panel, Index=1, Wrap=True)

# ---- group: Look-Up Table
panel_4 = Panel("""BL
PR
RD
YL
BR
GR
PK
OR""")
panel_5 = Panel("""0,0,255
255,0,255
255,0,0
255,255,0
180,180,70
0,255,0
200,100,100
200,100,0""")
member_index = MemberIndex(Set=panel_4, Member=list_item)  # -> Index, Count
list_item_2 = ListItem(List=panel_5, Index=member_index.Index, Wrap=True)

# ----
custom_preview = CustomPreview(Geometry=geojson_to_polyline_1_1.P_2, Shader=list_item_2)

# ==== cluster GeoJSONToPolyline11: Converts GeoJSON into Grasshopper geometry.
J = ClusterInput()
J_2 = Text(J)
rep = ReplaceText(Text=J_2, Find=" ", RecursiveReplace=False)
python = PythonScript(json_string=rep)  # -> doc, polylines, key, value, xyzList, coordList
# ---------- python: Python ----------
doc = """Split featureJSON into features
more exlantion here
HELLO!!!
"""
import json
import rhinoscriptsyntax as rs
import Rhino.Geometry as rg
appendPolyline = []

def main():
    raw_json = json.loads(json_string)
    features_list = raw_json["features"]
    propertieslist = [] 
    valuelist = []
    coordList =[]
    
    for item in features_list:
        coordinates = item['geometry']['coordinates']
        coordList.append(str(coordinates))
        try:#properties
            item['properties']
            properties=item['properties']
            propertieslist.append(properties)
            value = []
            for prop in properties:
                item_value = item['properties'][prop]
                value.append(item_value)
            valuelist.append(value)
        except KeyError: 
            properties = "<null>"
            propertieslist.append(properties)
    return {
            "coordList":coordList,
            "key":propertieslist,
            "value":valuelist,
            }
results = main()
coordList = results["coordList"]
key = results["key"]
value = results["value"]
#colour= results["colour"]
#polylines = results["polylines"]
#brep = results["brep"]
# ---------- end python ----------
python_2 = PythonScript(x=python.key)  # -> simplify(a)
# ---------- python_2: Python ----------
a=x
# ---------- end python_2 ----------
python_3 = PythonScript(x=python.value)  # -> simplify(a); same code as python_2
panel = Panel("""OUTPUTS:

Polyline Curve (P)- Closed Polyline.

Keys (K) - Outputs keys found in properties

Values (V) - Outputs values found in properties""")
panel_2 = Panel(""" 
INPUTS: 

GeoJSON (J) - FeatureCollection containing geoemtry type objects.
*Only accepts easting, northing (N,E) coordinates.
 """)
panel_3 = Panel("For more documentation visit: github.com/madeleinejohanson/Humpback")
lng = ListLength(List=python.coordList)

# ---- group: List of coordinates
data = Data(python.coordList)

# ----
equals = Equality(FirstNumber=lng, SecondNumber=1)  # -> Equality, Inequality
rep_2 = ReplaceText(Text=data, Find=" ", RecursiveReplace=False)
gate = StreamGate(Gate=0)  # -> Target0, Target1
split = TextSplit(Text=rep_2, Separators=",")  # -> simplify(Result)
merge = Merge(
    Data1="GEOJSON TO POLYGON",
    Data2="Converts GeoJSON into Grasshopper geometry.",
    Data3=panel_2,
    Data4=panel,
    Data5=panel_3)
doc = Text(merge)

cull_i = CullIndex(List=split, Indices=0, Wrap=True)
cull_i_2 = CullIndex(List=cull_i, Indices=-1, Wrap=True)

doc_2 = ClusterOutput(doc)
dispatch = Dispatch(List=cull_i_2, DispatchPattern=[False, True])  # -> simplify(ListA), ListB
chars = Characters(Text=dispatch.ListA)  # -> Result, Unicode
mindex = MemberIndex(Set=chars.Result, Member="[")  # -> Index, Count
equals_2 = Equality(FirstNumber=mindex.Count, SecondNumber=2)  # -> simplify(Equality), Inequality
trim = TrimTree(Tree=equals_2.Equality, Depth=1)
ma = MassAddition(Input=trim)  # -> Result, PartialResults
dispatch_2 = Dispatch(List=dispatch.ListA, DispatchPattern=trim)  # -> ListA, ListB
larger = LargerThan(FirstNumber=flatten(ma.Result), SecondNumber=0)  # -> LargerThan, OrEqualTo
viewer = ParamViewer(ma.Result)
index = ItemIndex(List=split, Item=dispatch_2.ListA)  # -> simplify(Index)
clean = CleanTree(RemoveNulls=True, RemoveInvalid=True, RemoveEmpty=True, Tree=index)
short = ShortestList(ListA=Slider(0, range=0..100), ListB=clean, TrimMode=2)  # -> ListA, ListB
dispatch_3 = Dispatch(List=viewer, DispatchPattern=larger.LargerThan)  # -> ListA, ListB
branch = TreeBranch(Tree=split, Path=dispatch_3.ListA, MaintainPaths=True)
branch_2 = TreeBranch(Tree=split, Path=dispatch_3.ListB, MaintainPaths=True)  # -> simplify(Branch)
lng_2 = ListLength(List=branch)
merge_2 = Merge(Data1=short.ListA, Data2=index, Data3=lng_2)
cull_i_3 = CullIndex(List=merge_2, Indices=-1, Wrap=True)
shift = ShiftList(List=merge_2, Shift=1, Wrap=False)
path_mapper = PathMapper(branch_2, source="{A}", target="{A;0}")
subtraction = Subtraction(A=shift, B=cull_i_3)
partition = PartitionList(List=split, Size=subtraction)  # -> simplify(Chunks)
merge_3 = Merge(Data1=path_mapper, Data2=partition)
filter = StreamFilter(Gate=equals.Equality, Stream0=merge_3, Stream1=split)
rep_3 = ReplaceText(Text=filter, Find="[", RecursiveReplace=False)
rep_4 = ReplaceText(Text=rep_3, Find="]", RecursiveReplace=False)
dispatch_4 = Dispatch(List=rep_4, DispatchPattern=[True, False])  # -> ListA, ListB
number_slider = Slider(100000, range=0..100000)
K = Text(simplify(python_2))
V = Data(simplify(python_3))
multiplication = Multiplication(A=dispatch_4.ListB, B=number_slider)
multiplication_2 = Multiplication(A=dispatch_4.ListA, B=number_slider)
pt = ConstructPoint(XCoordinate=multiplication_2, YCoordinate=multiplication, ZCoordinate=0)
lng_3 = ListLength(List=pt)
join = TextJoin(Text=K, Join="█")
join_2 = TextJoin(Text=V, Join="█")
larger_2 = LargerThan(FirstNumber=lng_3, SecondNumber=2)  # -> LargerThan, OrEqualTo
pline = PolyLine(Vertices=pt, Closed=larger_2.LargerThan)
crv = Curve(pline)
P = Curve(simplify(crv))
utrim = UberTrim(data=P, bool=False)
lng_4 = ListLength(List=utrim)
repeat = RepeatData(Data=join, Length=lng_4)
repeat_2 = RepeatData(Data=join_2, Length=lng_4)
split_2 = TextSplit(Text=repeat, Separators="█")  # -> simplify(Result)
split_3 = TextSplit(Text=repeat_2, Separators="█")  # -> simplify(Result)
P_2 = ClusterOutput(P)
K_2 = Text(simplify(split_2))
V_2 = Data(simplify(split_3))
K_3 = ClusterOutput(K_2)
V_3 = ClusterOutput(V_2)

# ==== cluster UberTrim: Better version of Trim
data = ClusterInput()
bool = ClusterInput()
data_2 = Data(data)
trim = TrimTree(Tree=data_2, Depth=1)
null = NullItem(Item=trim)  # -> NullFlags, InvalidFlags, Description
dispatch = Dispatch(List=data_2, DispatchPattern=null.NullFlags)  # -> ListA, ListB
bool_2 = Boolean(bool)
bool_3 = Boolean(invert(null.NullFlags))
trim_2 = TrimTree(Tree=dispatch.ListB, Depth=1)
flatten = FlattenTree(Tree=dispatch.ListA, Path="{0}")
merge = Merge(Data1=flatten, Data2=trim_2)
panel = Panel(null.NullFlags)
trim_3 = TrimTree(Tree=data_2, Depth=bool_3)
bool_4 = Boolean(invert(bool_2))
data_3 = Data(trim_3)
dispatch_2 = Dispatch(List=merge, DispatchPattern=bool_4)  # -> ListA, ListB
dispatch_3 = Dispatch(List=data_3, DispatchPattern=bool_2)  # -> ListA, ListB
clean = CleanTree(RemoveNulls=True, RemoveInvalid=True, RemoveEmpty=True, Tree=dispatch_3.ListB)
clean_2 = CleanTree(RemoveNulls=True, RemoveInvalid=True, RemoveEmpty=True, Tree=dispatch_2.ListB)
merge_2 = Merge(Data1=clean, Data2=clean_2)
R = ClusterOutput(merge_2)
panel_2 = Panel(merge_2)
