# Grasshopper definition prosthetic.gh (Grasshopper 1.0.4)
# plug-ins: LunchBox

construct_point = ConstructPoint(XCoordinate=0, YCoordinate=Slider(0.25, range=0..1), ZCoordinate=Slider(3.9, range=0..10))
ellipse = Ellipse(Plane=construct_point, Radius1=Slider(1.5, range=0..10), Radius2=Slider(2, range=0..10))  # -> Ellipse, Focus1, Focus2

construct_point_2 = ConstructPoint(XCoordinate=0, YCoordinate=Slider(0.7, range=0..10), ZCoordinate=Slider(8.6, range=0..10))
ellipse_2 = Ellipse(Plane=construct_point_2, Radius1=Slider(2.1, range=0..10), Radius2=Slider(2.5, range=0..10))  # -> Ellipse, Focus1, Focus2

construct_point_3 = ConstructPoint(XCoordinate=0, YCoordinate=Slider(0.7, range=0..10), ZCoordinate=Slider(12, range=0..100))
ellipse_3 = Ellipse(Plane=construct_point_3, Radius1=Slider(2.3, range=0..10), Radius2=Slider(2.2, range=0..10))  # -> Ellipse, Focus1, Focus2

construct_point_4 = ConstructPoint(XCoordinate=0, YCoordinate=0, ZCoordinate=0)
ellipse_4 = Ellipse(Plane=construct_point_4, Radius1=Slider(1.4, range=0..10), Radius2=Slider(1.7, range=0..10))  # -> Ellipse, Focus1, Focus2

# ---- group: Motion Data Collected from Dance
number_slider = Slider(10, range=0..10)
domain_box = DomainBox(Base=PlaneXY(0, 0, 0), X=number_slider, Y=number_slider, Z=number_slider)
populate_3d = Populate3D(Region=domain_box, Count=Slider(12, range=0..100), Seed=1)
interpolate = Interpolate(Vertices=populate_3d, Degree=3, Periodic=False, KnotStyle=1)  # -> Curve, Length, Domain

# ---- group: Loft Calf Form
loft = Loft(
    Curves=[ellipse_4.Ellipse, ellipse.Ellipse, ellipse_2.Ellipse, ellipse_3.Ellipse],
    Options={Adjust=False, Closed=False, LoftEnds=0, LoftSimp=0, LoftType=0, Rebuild=10, Refit=0.01})

# ---- group: Move Prosthetic Form to Center of 'Dance'
bounding_box = BoundingBox(Content=loft, Plane=PlaneXY(0, 0, 0))  # -> Box, Box_2
volume = Volume(Geometry=bounding_box.Box)  # -> Volume, Centroid
volume_2 = Volume(Geometry=domain_box)  # -> Volume, Centroid
vector_2pt = Vector2Pt(PointA=volume.Centroid, PointB=volume_2.Centroid, Unitize=False)  # -> Vector, Length
move = Move(Geometry=loft, Motion=vector_2pt.Vector)  # -> Geometry, Transform

# ----
number_slider_2 = Slider(32, range=0..100)
number_slider_3 = Slider(12, range=0..100)
diamond_panels = DiamondPanels(Surface=loft, UDivisions=number_slider_2, VDivisions=number_slider_2)  # -> DiamondPanels, TriPanels
skewed_quads = SkewedQuads(
    Surface=loft,
    UDivisions=Slider(12, range=0..100),
    VDivisions=Slider(15, range=0..100),
    TParameter=Slider(0.08, range=0..1))  # -> FullPanels, EdgePanels
triangle_panels_b = TrianglePanelsB(Surface=loft, UDivisions=number_slider_3, VDivisions=number_slider_3)
random_quad_panels = RandomQuadPanels(Surface=loft, UDivisions=Slider(11, range=0..100), VDivisions=Slider(36, range=0..100), RandomSeed=10)
brep_join = BrepJoin(Breps=[diamond_panels.DiamondPanels, diamond_panels.TriPanels])  # -> Breps, Closed

unit_x = UnitX(Factor=Slider(6, range=0..100))
move_2 = Move(Geometry=[skewed_quads.FullPanels, skewed_quads.EdgePanels], Motion=unit_x)  # -> Geometry, Transform

unit_x_2 = UnitX(Factor=Slider(18, range=0..100))
move_3 = Move(Geometry=triangle_panels_b, Motion=unit_x_2)  # -> Geometry, Transform

brep_join_2 = BrepJoin(Breps=random_quad_panels)  # -> Breps, Closed

unit_x_3 = UnitX(Factor=Slider(12, range=0..100))
move_4 = Move(Geometry=brep_join_2.Breps, Motion=unit_x_3)  # -> Geometry, Transform

# ---- group: Attract Dance Curve to Prosthetic
pull_curve = PullCurve(Curve=interpolate.Curve, Surface=move.Geometry)

# ---- group: Add Thicknes
pipe = Pipe(Curve=pull_curve, Radius=Slider(0.065, range=0..1), Caps=0)

# ----
group = Group(Objects=[pipe, move.Geometry])

unit_x_4 = UnitX(Factor=Slider(24, range=0..100))
move_5 = Move(Geometry=group, Motion=unit_x_4)  # -> Geometry, Transform

custom_preview = CustomPreview(
    Geometry=[brep_join.Breps, move_2.Geometry, move_4.Geometry, move_3.Geometry, move_5.Geometry],
    Shader=ColourSwatch(SwatchColor=RGB(33, 100, 117)))
