# Grasshopper definition stream.gh (Grasshopper 1.0.4)
# plug-ins: Kangaroo Components

# ---- group: Leading Vector Handles
vector_xyz = VectorXYZ(XComponent=0, YComponent=Slider(1.3, range=-10..10), ZComponent=Slider(-1.4, range=-10..10))  # -> Vector, Length

# ---- group: Trailing Point
construct_point = ConstructPoint(XCoordinate=0, YCoordinate=Slider(5.8, range=0..10), ZCoordinate=Slider(1.8, range=0..10))

# ---- group: Trailing Vector Handles
vector_xyz_2 = VectorXYZ(XComponent=0, YComponent=Slider(-5.6, range=-10..10), ZComponent=Slider(-1.6, range=-10..10))  # -> Vector, Length

# ---- group: Leading Point
construct_point_2 = ConstructPoint(XCoordinate=0, YCoordinate=Slider(-1.6, range=-10..10), ZCoordinate=Slider(0, range=-10..10))

# ---- group: Invert Vectors for Perfect Tangent Continuity
negative = Negative(Value=vector_xyz_2.Vector)
negative_2 = Negative(Value=vector_xyz.Vector)

# ---- group: Draw and Join Curves
bezier_span = BezierSpan(StartPoint=construct_point_2, StartTangent=vector_xyz.Vector, EndPoint=construct_point, EndTangent=vector_xyz_2.Vector)  # -> Curve, Length, Domain
bezier_span_2 = BezierSpan(StartPoint=construct_point_2, StartTangent=negative_2, EndPoint=construct_point, EndTangent=negative)  # -> Curve, Length, Domain
join_curves = JoinCurves(Curves=flatten([bezier_span.Curve, bezier_span_2.Curve]), Preserve=False)

# ---- group: Create End of Wing Cross Section
vector_xyz_3 = VectorXYZ(XComponent=Slider(7.5, range=0..10), YComponent=Slider(7.5, range=0..10), ZComponent=Slider(1.3, range=0..10))  # -> Vector, Length
move = Move(Geometry=join_curves, Motion=vector_xyz_3.Vector)  # -> Geometry, Transform

# ---- group: Scale Down and Rotate End of Wing
wing_tip_scale_factor = Slider(0.75, range=0..1)
area = Area(Geometry=move.Geometry)  # -> Area, Centroid
wing_tip_rotation = Slider(0.09, range=0..2)
scale = Scale(Geometry=move.Geometry, Center=area.Centroid, Factor=wing_tip_scale_factor)  # -> Geometry, Transform
yz_plane = YZPlane(Origin=area.Centroid)
pi = Pi(Factor=wing_tip_rotation)
rotate = Rotate(Geometry=scale.Geometry, Angle=pi, Plane=yz_plane)  # -> Geometry, Transform

# ---- group: Loft Wing
loft = Loft(
    Curves=[join_curves, rotate.Geometry],
    Options={Adjust=False, Closed=False, LoftEnds=0, LoftSimp=0, LoftType=0, Rebuild=10, Refit=0.01})
cap_holes = CapHoles(Brep=loft)

# ---- group: Simulation Region
bounding_box = BoundingBox(Content=cap_holes, Plane=PlaneXY(0, 0, 0))  # -> Box, Box_2
sim_box_scale_up_factor = Slider(1.3, range=0..10)
area_2 = Area(Geometry=bounding_box.Box)  # -> Area, Centroid
scale_2 = Scale(Geometry=bounding_box.Box, Center=area_2.Centroid, Factor=sim_box_scale_up_factor)  # -> Geometry, Transform

# ---- group: Create Planes of Wind Particles
deconstruct_box = DeconstructBox(Box=scale_2.Geometry)  # -> Plane, X, Y, Z
particle_count_x = Slider(5, range=0..20)
particle_count_z = Slider(10, range=0..20)
range = Range(Domain=deconstruct_box.Z, Steps=particle_count_z)
range_2 = Range(Domain=deconstruct_box.X, Steps=particle_count_x)  # -> graft(Range)
deconstruct_domain = DeconstructDomain(Domain=deconstruct_box.Y)  # -> Start, End
construct_point_3 = ConstructPoint(XCoordinate=range_2, YCoordinate=deconstruct_domain.Start, ZCoordinate=range)

# ----
deconstruct_brep = DeconstructBrep(Brep=scale_2.Geometry)  # -> Faces, Edges, Vertices
random_point_count = Slider(78, range=0..100)
list_item = ListItem(List=deconstruct_brep.Faces, Index=0, Wrap=True)
populate_2d = Populate2D(Region=list_item, Count=random_point_count, Seed=1)

# ----
# Optionally connect "Populate2D" instead to "Point" for random wind starting points
point = Point(construct_point_3)

# ---- group: Model Airflow
wind_speed = Slider(7, range=0..10)
unit_y = UnitY(Factor=wind_speed)
unaryforce = UnaryForce(Point=point, Force=unit_y)

# ---- group: Model Rigid Body Dynamics
surface_elasticity = Slider(0.44, range=0..1)
collidesurf = CollideSurf(Solid=cap_holes, Points=point, Hardness=surface_elasticity)

# ----
panel = Panel("Kangaroo Forces")
# Double Click for Play/Pause Button
# 
# Right click it to change update speed…
reset_simulation = BooleanToggle(True)
timer = Timer(TimerInterval=50, Target=kangaroophysics)  # disabled

# ---- group: Physics Simulator
# To run simulation…
# 
# "Reset Simulation" should be false and the timer node "50 ms" should be colored in.
kangaroophysics = KangarooPhysics(ForceObjects=flatten([collidesurf, unaryforce]), Settings=null, SimulationReset=reset_simulation)  # -> Out, Iterations, ParticlesOut, GeometryOut, KE

# ---- group: Draw Streams
trail = Trail(Points=kangaroophysics.ParticlesOut, Reset=reset_simulation, Record=True)
